# Grasshopper definition 4d1d8dd2.gh (Grasshopper 1.0.8)
# plug-ins: Human, MetaHopper, UiPlus

# ---- group: EPW DropDown List
# EPW
epw_link_list_israel = Panel("""https://climate.onebuilding.org/WMO_Region_6_Europe/ISR_Israel/Z_HaTsafon/ISR_Z_Mahanaim-Pina.AP.401761_TMYx.zip
https://climate.onebuilding.org/WMO_Region_6_Europe/ISR_Israel/Z_HaTsafon/ISR_Z_Zefat.Har.Kenaan.MS.401530_TMYx.2004-2018.zip
https://climate.onebuilding.org/WMO_Region_6_Europe/ISR_Israel/Z_HaTsafon/ISR_Z_Haifa.AP.401550_TMYx.zip
https://climate.onebuilding.org/WMO_Region_6_Europe/ISR_Israel/Z_HaTsafon/ISR_Z_Ramat.David.AB.401650_TMYx.zip
https://climate.onebuilding.org/WMO_Region_6_Europe/SYR_Syrian_Arab_Republic/SYR_QU_Sweida-UNDOF.400670_TMYx.zip
https://climate.onebuilding.org/WMO_Region_6_Europe/ISR_Israel/M_HaMerkaz/ISR_M_Netanya.401730_TMYx.zip
https://climate.onebuilding.org/WMO_Region_6_Europe/ISR_Israel/TA_Tel-Aviv/ISR_TA_Tel.Aviv-Sde.Dov.AP.401762_TMYx.zip
https://climate.onebuilding.org/WMO_Region_6_Europe/ISR_Israel/TA_Tel-Aviv/ISR_TA_Tel.Aviv-Bet.Dagan.401790_TMYx.zip
https://climate.onebuilding.org/WMO_Region_6_Europe/ISR_Israel/TA_Tel-Aviv/ISR_TA_Tel.Aviv-Ben.Gurion.Intl.AP.401800_TMYx.zip
https://climate.onebuilding.org/WMO_Region_6_Europe/ISR_Israel/JM_Yerushalayim/ISR_JM_Jerusalem.Center.401830_TMYx.2004-2018.zip
https://climate.onebuilding.org/WMO_Region_6_Europe/PSE_Palestine/PSE_WBK_Hebron.402400_TMYx.zip
https://climate.onebuilding.org/WMO_Region_6_Europe/PSE_Palestine/PSE_GZZ_Gaza.623380_TMYx.zip
https://climate.onebuilding.org/WMO_Region_6_Europe/PSE_Palestine/PSE_GZZ_Yasser.Arafat.Intl.AP-Gaza.Intl.AP.402300_TMYx.zip
https://climate.onebuilding.org/WMO_Region_6_Europe/ISR_Israel/D_HaDarom/ISR_D_Beer.Sheva-Teyman.AP.401910_TMYx.zip
https://climate.onebuilding.org/WMO_Region_6_Europe/ISR_Israel/D_HaDarom/ISR_D_Beer.Sheva.401900_TMYx.zip
https://climate.onebuilding.org/WMO_Region_6_Europe/ISR_Israel/D_HaDarom/ISR_D_Ovda.AP.401980_TMYx.zip
https://climate.onebuilding.org/WMO_Region_6_Europe/ISR_Israel/D_HaDarom/ISR_D_Eilat-Hozman.AP.401990_TMYx.zip""")
split = TextSplit(Text=epw_link_list_israel, Separators="/")
item = ListItem(List=reverse(split), Index=0, Wrap=True)
split_2 = TextSplit(Text=item, Separators="_")
item_2 = ListItem(List=split_2, Index=2, Wrap=True)  # -> flatten(Item)
dropdown_list = UiDropdownList(Values=item_2, Index=7)
get_values = UIValues(Element=dropdown_list)
item_3 = ListItem(List=epw_link_list_israel, Index=get_values, Wrap=True)

# ---- group: North rotate
dom = ConstructDomain(DomainStart="0", DomainEnd="360")
slider = UISlider(Label="North", Value=Slider(0, range=0..360), Bounds=dom, Increment=Slider(1, range=0..1))
get_values_2 = UiValues(Element=slider)

# ----
panel = Panel("""-------------------------------------------------------------------------------
Analysis period- Start to End""")
list = ValueList({"Body": 0, "Bold": 1, "Title": 2, "Subtitle": 3, "Subtext": 4}, selected="Body")
label = UILabel(Label=panel, Style=list)

# ----
# Title
panel_2 = Panel("""Calculate the number of hours of direct sunlight 
received by geometry using sun vectors.""")
text_block = UITextBlock(Text=panel_2)

text_block_2 = UITextBlock(Text="Shadow Analysis")

# ----
# # IMPORTANT:
# Ensure the document is set to 'Meters'
# before running the script.
# 
# If not, close Rhino, reopen it, set units to 'Meters',
# and then run the script.
units_check = GhPythonScript()
# ---------- units_check: Python ----------
import rhinoscriptsyntax as rs
import Rhino
import scriptcontext as sc
from System.Windows.Forms import MessageBox

# Get the active Rhino document
doc = Rhino.RhinoDoc.ActiveDoc

# Check if the document is not using meters as the unit
if doc.ModelUnitSystem != Rhino.UnitSystem.Meters:
    # Display a popup message with additional instructions
    MessageBox.Show(
        "Warning: Rhino document units are not set to meters.\n\n"
        "Please close Rhino completely, reopen it, change the units to Meters, "
        "and only then open the Grasshopper file.",
        "Units Check"
    )
# ---------- end units_check ----------

# ----
# Select GEO
panel_3 = Panel("Analysis Surface")
rh_sel_btn = UiRhinoSelectButton(Label=panel_3, Filter=16)
rh_sel_btn_2 = UiRhinoSelectButton(Label="Context", Filter=16)
get_values_3 = UIValues(Element=rh_sel_btn_2)
get_values_4 = UIValues(Element=rh_sel_btn)
srf = Surface(get_values_4)
brep = Brep(get_values_3)

# ----
# Run
panel_4 = Panel("Run")
button = UiButton(Label=panel_4)
get_values_5 = UiValues(Element=button)
panel_5 = Panel(get_values_5)
entwine = Entwine(Branch00=srf, Branch01=brep, FlattenInputs=True)

font = UiSetFont(Element=[text_block_2, button], Family="Rajdhani", Size=20, Bold=True)
panel_6 = Panel("""0
1
2""")
panel_7 = Panel("""0
0
0""")
panel_8 = Panel("""0
0
0""")
panel_9 = Panel("""0
1
2""")
panel_10 = Panel(item_3)
panel_11 = Panel("""0
0
0""")
panel_12 = Panel("""0
1
2""")

card = UiCardLayout(Elements=button, Title="Run")

button_2 = Merge(Data1=flatten(rh_sel_btn), Data2=flatten(rh_sel_btn_2))
card_2 = UiCardLayout(Elements=button_2, Title="Select Geometry")

list_2 = ValueList({"Yearly Preview": 0, "Daily Preview": 1}, selected="Daily Preview")

# ----
# SkyMask
bang = ExplodeTree()  # -> Branch0, Branch1, Branch2, Branch3
data = Data([bang.Branch0, bang.Branch1])
preview = CustomPreview(
    Geometry=data,
    Material={diffuse=RGB(221, 160, 221), emission=RGB(66, 48, 66), shine=0.5, specular=RGB(255, 255, 255), transparency=0})

Z = UnitZ(Factor=Slider(0.001, range=0..0.001))

# ----
# Shadow Analysis Preview
shadow = ExplodeTree()  # -> Branch0, Branch1, Branch2

panel_13 = Panel("""Low Res Grid [Faster]
Mid Res Grid
High Res Grid
Ultra Res Grid [Slower]
Hyper Res Grid [Slowest]""")
panel_14 = Panel("""10
5
1
0.3
0.1""")

# ---- group: Res Grid
dropdown_list_2 = UiDropdownList(Values=panel_13, Index=2)

# ----
get_values_6 = UiValues(Element=dropdown_list_2)
item_4 = ListItem(List=panel_14, Index=get_values_6, Wrap=True)
panel_15 = Panel(item_4)

# ----
# Settings
panel_16 = Panel("""Low Res Grid [Faster]
Mid Res Grid
High Res Grid
Ultra Res Grid [Slower]
Hyper Res Grid [Slowest]""")
panel_17 = Panel("""10
5
1
0.3
0.1""")

# ---- group: Res Grid
dropdown_list_3 = UiDropdownList(Values=panel_16, Index=0)

# ----
get_values_7 = UiValues(Element=dropdown_list_3)
item_5 = ListItem(List=panel_17, Index=get_values_7, Wrap=True)
panel_18 = Panel(item_5)

# ---- group: Sun Scale
number_slider = Slider(1, range=0.1..20)
number_slider_2 = Slider(0.5, range=0..1)
panel_19 = Panel("Sun Scale")
dom_2 = ConstructDomain(DomainStart=Slider(0.5, range=0..1), DomainEnd=Slider(10, range=0..10))

# ----
slider_2 = UISlider(Label=panel_19, Value=number_slider, Bounds=dom_2, Increment=number_slider_2)

# ---- group: Sun Scale (continued)
get_values_8 = UiValues(Element=slider_2)

# ----
list_3 = ValueList({"Left": 0, "Center": 1, "Right": 2, "Stretch": 3}, selected="Stretch")
resize = UiResize(Element=[dropdown_list, rh_sel_btn, rh_sel_btn_2, dropdown_list_2, slider_2, slider, button], Alignment=list_3)

# ---- group: Start Month
number_slider_3 = Slider(1, range=0..10)
number_slider_4 = Slider(1, range=1..12)
toggle = BooleanToggle(True)
panel_20 = Panel("End Month (1-12)")
dom_3 = ConstructDomain(DomainStart="1", DomainEnd="12")

# ----
scroll_integer = UIScrollInteger(Integer=number_slider_4, Wrap=toggle, Increment=number_slider_3, Bounds=dom_3)

# ---- group: Start Month (continued)
get_values_9 = UiValues(Element=scroll_integer)
panel_21 = Panel(get_values_9)

# ---- group: Start Day
number_slider_5 = Slider(1, range=0..10)
number_slider_6 = Slider(8, range=0..23)
toggle_2 = BooleanToggle(True)
panel_22 = Panel("End Day (1-31)")
dom_4 = ConstructDomain(DomainStart="0", DomainEnd="31")

# ----
scroll_integer_2 = UIScrollInteger(Integer=number_slider_6, Wrap=toggle_2, Increment=number_slider_5, Bounds=dom_4)

# ---- group: Start Day (continued)
get_values_10 = UiValues(Element=scroll_integer_2)
panel_23 = Panel(get_values_10)

# ---- group: Start Month
number_slider_7 = Slider(1, range=0..10)
number_slider_8 = Slider(1, range=1..12)
toggle_3 = BooleanToggle(True)
panel_24 = Panel("Start Month (1-12)")
dom_5 = ConstructDomain(DomainStart="1", DomainEnd="12")

# ----
scroll_integer_3 = UIScrollInteger(Integer=number_slider_8, Wrap=toggle_3, Increment=number_slider_7, Bounds=dom_5)

# ---- group: Start Month (continued)
get_values_11 = UiValues(Element=scroll_integer_3)
panel_25 = Panel(get_values_11)

# ---- group: Start Hour Time
panel_26 = Panel("Start Hour(0-23)")
number_slider_9 = Slider(1, range=0..10)
number_slider_10 = Slider(8, range=0..23)
toggle_4 = BooleanToggle(True)
dom_6 = ConstructDomain(DomainStart="0", DomainEnd="23")

# ----
scroll_integer_4 = UIScrollInteger(Integer=number_slider_10, Wrap=toggle_4, Increment=number_slider_9, Bounds=dom_6)

# ---- group: Start Hour Time (continued)
get_values_12 = UiValues(Element=scroll_integer_4)
panel_27 = Panel(get_values_12)

# ---- group: Start Day
number_slider_11 = Slider(1, range=0..10)
number_slider_12 = Slider(8, range=0..23)
toggle_5 = BooleanToggle(True)
panel_28 = Panel("Start Day (1-31)")
dom_7 = ConstructDomain(DomainStart="0", DomainEnd="31")

# ----
scroll_integer_5 = UIScrollInteger(Integer=number_slider_12, Wrap=toggle_5, Increment=number_slider_11, Bounds=dom_7)

# ---- group: Start Day (continued)
get_values_13 = UiValues(Element=scroll_integer_5)
panel_29 = Panel(get_values_13)

# ----
merge = Merge(Data1=flatten(panel_26), Data2=flatten(panel_28), Data3=flatten(panel_24))

panel_30 = Panel(merge)
list_4 = ValueList({"Body": 0, "Bold": 1, "Title": 2, "Subtitle": 3, "Subtext": 4}, selected="Body")
label_2 = UILabel(Label=merge, Style=list_4)

merge_2 = Merge(Data1=flatten(scroll_integer_4), Data2=flatten(scroll_integer_5), Data3=flatten(scroll_integer_3))
grid = UiGridLayout(Elements=merge_2, Columns=panel_9, Rows=panel_8)
grid_2 = UiGridLayout(Elements=label_2, Columns=panel_9, Rows=panel_8)

# ---- group: End Hour Time
number_slider_13 = Slider(1, range=0..10)
number_slider_14 = Slider(8, range=0..23)
toggle_6 = BooleanToggle(True)
panel_31 = Panel("End Hour (0-23)")
dom_8 = ConstructDomain(DomainStart="0", DomainEnd="23")

# ----
scroll_integer_6 = UIScrollInteger(Integer=number_slider_14, Wrap=toggle_6, Increment=number_slider_13, Bounds=dom_8)

# ---- group: End Hour Time (continued)
get_values_14 = UiValues(Element=scroll_integer_6)
panel_32 = Panel(get_values_14)

# ----
merge_3 = Merge(Data1=flatten(panel_31), Data2=flatten(panel_22), Data3=flatten(panel_20))

panel_33 = Panel(merge_3)
list_5 = ValueList({"Body": 0, "Bold": 1, "Title": 2, "Subtitle": 3, "Subtext": 4}, selected="Body")
label_3 = UILabel(Label=merge_3, Style=list_5)

merge_4 = Merge(Data1=flatten(scroll_integer_6), Data2=flatten(scroll_integer_2), Data3=flatten(scroll_integer))
grid_3 = UiGridLayout(Elements=merge_4, Columns=panel_6, Rows=panel_7)
grid_4 = UiGridLayout(Elements=label_3, Columns=panel_12, Rows=panel_11)
merge_5 = Merge(
    Data1=flatten(dropdown_list),
    Data2=flatten(dropdown_list_2),
    Data3=flatten(slider_2),
    Data4=flatten(slider),
    Data5=flatten(label),
    Data6=flatten(grid_2),
    Data7=flatten(grid),
    Data8=flatten(grid_4),
    Data9=flatten(grid_3))

card_3 = UiCardLayout(Elements=merge_5, Title="Analysis Settings")

spacer = UiSpacer(Width=10, Horizontal=False)
merge_6 = Merge(Data1=flatten(card_2), Data2=flatten(spacer), Data3=flatten(card_3), Data4=flatten(spacer), Data5=flatten(card))
panel_34 = Panel(merge_6)
lng = ListLength(List=merge_6)
merge_7 = Merge(Data1=flatten(merge_6))
dup = DuplicateData(Data="Analysis", Number=lng, Order=True)
tab = UiTabbedLayout(Elements=merge_7, Names=dup)

swatch = ColourSwatch(SwatchColor=RGB(237, 237, 237))
merge_8 = Merge(Data1=flatten(card_2), Data2=flatten(card), Data3=flatten(card_3))
swatch_2 = ColourSwatch(SwatchColor=RGB(237, 237, 237))
graphics = UiSetGraphics(
    Element=merge_8,
    PrimaryColor=ColourSwatch(SwatchColor=RGB(0, 0, 0)),
    AccentColor=ColourSwatch(SwatchColor=RGB(255, 255, 255)),
    StrokeColor=swatch_2,
    StrokeWeight=0)
graphics_2 = UiSetGraphics(
    Element=button_2,
    PrimaryColor=ColourSwatch(SwatchColor=RGB(115, 115, 115)),
    AccentColor=swatch_2,
    StrokeColor=swatch_2,
    StrokeWeight=0)

merge_9 = Merge(Data1=flatten(text_block_2), Data3=flatten(text_block), Data4=flatten(tab))
font_2 = UiSetFont(Element=merge_9, Family="Rajdhani")

pt = Point(Point(0, 0, 0))
pt_2 = ConstructPoint(XCoordinate=Slider(75, range=0..200), YCoordinate=Slider(51, range=0..500), ZCoordinate=0)
window = UIWindow(Elements=merge_9, Title="ArchiTool V3.0", Owner=2, Scroll=True, Launch=Toggle(True))
modify_win = UiModifyWindow(Window=window, Position=pt_2, HideControls=True, HideTitle=True)

analysisperiod = LBAnalysisPeriod(
    start_month=get_values_11,
    start_day=get_values_13,
    start_hour=get_values_12,
    end_month=get_values_9,
    end_day=get_values_10,
    end_hour=get_values_14)  # -> period, hoys, dates; plug-in component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

# ---- group: ad
dam = DataDam(DataGeoInputs=entwine, BufferDelay=10000000, BufferMode=0)
dam_2 = DataDam(DataScale_Sun=get_values_8, BufferDelay=10000000, BufferMode=0)
dam_3 = DataDam(DataSunScale=get_values_8, BufferDelay=10000000, BufferMode=0)
dam_4 = DataDam(DataResGrid=item_4, BufferDelay=10000000, BufferMode=0)
dam_5 = DataDam(DataEPW=item_3, BufferDelay=10000000, BufferMode=0)
dam_6 = DataDam(DataNorth=get_values_2, BufferDelay=10000000, BufferMode=0)
objfromgroup = GetObjectsInGroup()
dam_7 = DataDam(DataHoy=analysisperiod.hoys, BufferDelay=10000000, BufferMode=0)

# ----
lng_2 = ListLength(List=objfromgroup)
dup_2 = DuplicateData(Data=get_values_5, Number=lng_2, Order=True)
setobj = SetObjectValue(ObjectToSet=objfromgroup, ValueToSet=dup_2)

data_2 = Data(dam)
data_3 = Data(data_2)

# ----
# 2 .EPW Link
downloadepw = LBDownloadWeather(weather_URL=dam_5)  # -> epw_file, stat_file, ddy_file; plug-in component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

brep_2 = Brep(data_3)
bang_2 = ExplodeTree(Data=brep_2)  # -> Branch0, Branch1
context_buildings_trees = Brep(bang_2.Branch1)

shadow_analysis_2 = ShadowAnalysis_2(
    run=brep_2,
    analysis_surface=bang_2.Branch0,
    contex=bang_2.Branch1,
    grid_res=dam_4,
    north=dam_6,
    hoys=dam_7,
    scale=dam_2,
    epw=downloadepw.epw_file,
    daily=list_2,
    G=0)  # -> log, sundiagram, R, daily_2, directsun, results
panel_35 = Panel(shadow_analysis_2.log)

# ---- group: altitudes
previewlw = CustomPreviewLineweights(
    Geometry=shadow_analysis_2.R,
    Shader=ColourSwatch(SwatchColor=RGB(115, 115, 115)),
    Thickness=Slider(2, range=0..10),
    Absolute=False)

# ----
# Context Preview
number_slider_15 = Slider(1, range=0..10)
wires = BrepWireframe(Brep=context_buildings_trees, Density=-1)
previewlw_2 = CustomPreviewLineweights(Geometry=wires, Shader=ColourSwatch(SwatchColor=RGB(26, 26, 26)), Thickness=number_slider_15, Absolute=False)
preview_2 = CustomPreview(Geometry=context_buildings_trees, Material=ColourSwatch(SwatchColor=RGB(255, 255, 255)))

data_4 = Data(shadow_analysis_2.directsun)

# ---- group: altitudes
# SunPath Preview
bang_3 = ExplodeTree(Data=shadow_analysis_2.sundiagram)  # -> Branch0, Branch1, Branch2, Branch3
tag = TextTag(Location=bang_3.Branch1, Text=bang_3.Branch0, Colour=RGB(0, 0, 0))

# ----
move = Move(Geometry=data_4, Motion=Z)  # -> Geometry, Transform

# ==== cluster ShadowAnalysis_2

# ----
# Improve Performance
# SktMask - Bug Fix
# Terrain as Context
# Important Note - Meter (ME)
run = ClusterInput()
bang = ExplodeTree(Data=run)  # -> Branch0, Branch1

# ----
# Error: No Active Educational License Detected
# 
# It appears that no active Educational License is available for 01A_ArchiTools. Please contact support at info@01Architecture.com for assistance.
# 
# Yaniv Hatiel
item = ListItem(List=flatten(bang.Branch0), Index=0, Wrap=True)
authorization_v2_limit = GhPythonScript(toggle=item)  # -> out, a; disabled
# ---------- authorization_v2_limit: Python ----------
import urllib
import json
import Rhino

# Node.js server URL
auth_url = "https://01aarchitools-production.up.railway.app/authorize"

def check_authorization(serialNumber):
    try:
        # Build the URL with the serial number as a query parameter
        url = "{}?serialNumber={}".format(auth_url, serialNumber)
        
        # Send the GET request to the Node server
        req = urllib.urlopen(url)
        response = req.read()
        
        # Parse the response
        response_data = json.loads(response)
        
        # Check if authorized
        authorized = response_data.get('authorized', False)
        message = response_data.get('message', "No message").strip()  # Ensure no trailing/leading spaces
        remaining_uses = response_data.get('remainingUses', 0)
        
        return authorized, message, remaining_uses
    except Exception as e:
        print("Authorization check failed: {}".format(e))
        return False, "Error: Could not connect to the server", 0

def process_authorization(toggle):
    if toggle:
        # Retrieve the Rhino serial number
        serialNumber = Rhino.RhinoApp.SerialNumber
        
        # Call the authorization function with the retrieved serial number
        isAuthorized, message, remaining_uses = check_authorization(serialNumber)

        # Output the authorization status
        if isAuthorized:
            print("Active Educational License")
            print("Remaining Daily Uses: {}".format(remaining_uses))
            print("1")
        elif "daily usage limit reached" in message.lower():
            print("Error: Daily limit for your educational license has been reached.")
            print("Please contact support at info@01Architecture.com for assistance.")
            print("3")
        else:
            print("Error: Unauthorized access.")
            print("Please check your license or contact support at info@01Architecture.com.")
            print("0")
    else:
        print("Toggle is set to False. Skipping authorization check.")
        print("0")

# Example toggle value (you can replace this with actual input from your UI or script environment)
toggle = True  # Set to True to check authorization, False to skip

# Process the authorization based on the toggle value
process_authorization(toggle)
print("01A_ArchiTools V2.0")
# ---------- end authorization_v2_limit ----------
authorization_v3_0_limit_vercel = Python3Script(toggle=item)  # -> out, a
# ---------- authorization_v3_0_limit_vercel: Python ----------
import requests
import Rhino
from requests.exceptions import RequestException

# Node.js server URL
AUTH_URL = "https://architool-v3-server.vercel.app/authorize"

# Create a session for connection reuse
session = requests.Session()

def check_authorization(serial_number: str) -> (bool, str, int):
    """
    Checks authorization by querying the Node.js server with the given serial number.

    Parameters:
        serial_number (str): The Rhino serial number.
        
    Returns:
        tuple: (authorized (bool), message (str), remaining_uses (int))
    """
    try:
        response = session.get(AUTH_URL, params={'serialNumber': serial_number}, timeout=5)
        response.raise_for_status()  # Ensure we raise for bad HTTP responses
        
        data = response.json()
        authorized = data.get('authorized', False)
        message = data.get('message', "No message").strip()
        remaining_uses = data.get('remainingUses', 0)
        
        return authorized, message, remaining_uses
    except RequestException as req_err:
        print(f"Request error during authorization check: {req_err}")
    except ValueError as json_err:
        print(f"JSON parsing error: {json_err}")
    except Exception as e:
        print(f"Unexpected error during authorization check: {e}")
    
    return False, "Error: Could not connect to the server", 0

def process_authorization(toggle: bool) -> None:
    """
    Processes the authorization check based on the toggle value.

    Parameters:
        toggle (bool): If True, perform the authorization check; if False, skip it.
    """
    if not toggle:
        print("Toggle is set to False. Skipping authorization check.")
        print("0")
        return

    serial_number = Rhino.RhinoApp.SerialNumber
    is_authorized, message, remaining_uses = check_authorization(serial_number)

    if is_authorized:
        print("Active Educational License")
        print(f"Remaining Daily Uses: {remaining_uses}")
        print("1")
    elif "daily usage limit reached" in message.lower():
        print("Error: Daily limit for your educational license has been reached.")
        print("Please contact support at info@01Architecture.com for assistance.")
        print("3")
    else:
        print("Error: Unauthorized access.")
        print("Please check your license or contact support at info@01Architecture.com.")
        print("0")

if __name__ == "__main__":
    toggle = True  # Replace or set this value as needed
    process_authorization(toggle)
    print("01A_ArchiTools V3.0")
# ---------- end authorization_v3_0_limit_vercel ----------
panel = Panel(authorization_v3_0_limit_vercel.out)
item_2 = ListItem(List=authorization_v3_0_limit_vercel.out, Index=0, Wrap=True)  # -> Item2, Item1, Item
item_3 = ListItem(List=panel, Index=0, Wrap=True)  # -> Item1, Item, Item1_2
python = GhPythonScript()  # -> out, a
# ---------- python: Python ----------
import sys

def check_ladybug_installed():
    try:
        # Attempt to import a Ladybug module
        import ladybug
        return "Ladybug is installed."
    except ImportError:
        return "Ladybug is not installed."

# Check for Ladybug installation
output = check_ladybug_installed()
print(output)
# ---------- end python ----------
python_2 = GhPythonScript()  # -> out, a; disabled
# ---------- python_2: Python ----------
import subprocess
import os

def check_radiance_installed():
    try:
        # Attempt to run a simple Radiance command
        result = subprocess.Popen(["rtrace", "-version"], stdout=subprocess.PIPE, stderr=subprocess.PIPE)
        stdout, stderr = result.communicate()
        if result.returncode == 0:
            return "Radiance is installed. Version: " + stdout.strip()
        else:
            return "Radiance command found but did not return a valid response."
    except OSError:
        return "Radiance is not installed or not added to the system PATH."

# Check for Radiance installation
output = check_radiance_installed()
print(output)
# ---------- end python_2 ----------
panel_2 = Panel(python.out)
relay = Relay()  # disabled
concat = Concatenate(
    FragmentC=item_3.Item,
    FragmentD="==============",
    FragmentA=panel_2,
    FragmentG=relay,
    FragmentH="==============",
    FragmentB=item_3.Item1,
    FragmentE="==============",
    FragmentI=item_3.Item1_2)
panel_3 = Panel(concat)
log = ClusterOutput(concat)
autorized = Data(item_2.Item2)

analysis_surface = ClusterInput()
contex = ClusterInput()
grid_res = ClusterInput()
epw = ClusterInput()

filter = StreamFilter(Gate=autorized, Stream1=grid_res)
filter_2 = StreamFilter(Gate=autorized, Stream1=analysis_surface)
filter_3 = StreamFilter(Gate=autorized, Stream1=epw)
bang_2 = ExplodeTree(Data=filter_2)  # -> Branch0, Branch1
importepw = LBImportEPW(epw_file=epw)  # -> location, dry_bulb_temperature, dew_point_temperature, relative_humidity, wind_speed, wind_direction, direct_normal_rad, diffuse_horizontal_rad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; plug-in component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
scale = ClusterInput()
filter_4 = StreamFilter(Gate=autorized, Stream1=scale)
north = ClusterInput()
hoys = ClusterInput()
daily = ClusterInput()
sunpath = LBSunPath(north=north, location=importepw.location, hoys=hoys, scale=scale, daily=daily)  # -> report, vectors, altitudes, azimuths, hoys, sun_pts, analemma, daily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; plug-in component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

colrange = LBColorRange(index=Slider(5, range=0..10))  # -> colors; plug-in component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
legendpar = LBLegendParameters(colors=colrange)  # -> leg_par; plug-in component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
data = Data(legendpar)

filter_5 = StreamFilter(Gate=autorized, Stream1=contex)
data_2 = Data(filter_5)
list = ValueList({"Top": 1, "Bottom": -1, "Side": 0}, selected="Bottom")
bbox = BoundingBox(Content=data_2, Plane=PlaneXY(0, 0, 0), UnionBox=True)  # -> Box, Box_2
sorting_surfaces = SortingSurfaces(top_bottom_inside=list, brep=bbox.Box)  # -> simplify(surfaces)
pcen = PolygonCenter(Polyline=sorting_surfaces)  # -> CenterV, CenterE, CenterA

G = ClusterInput()

filter_6 = StreamFilter(Gate=G, Stream1=sunpath.vectors)  # disabled
panel_5 = Panel("Rendered")  # disabled
viewfromsun = LBViewFromSun(vector=filter_6, center_pt=pcen.CenterA, mode=panel_5)  # -> report; disabled; plug-in component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

brep = Brep(bang.Branch1)
brep_2 = Brep(bang.Branch0)
directsunhours = LBDirectSunHours(
    vectors=flatten(sunpath.vectors),
    geometry=flatten(brep_2),
    context=flatten([brep, brep_2]),
    grid_size=filter,
    offset_dist=1,
    legend_par=legendpar,
    run=Toggle(True))  # -> out, points, results, mesh, legend, title, int_mtx; plug-in component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

pdecon = Deconstruct(Point=pcen.CenterA)  # -> XComponent, YComponent, ZComponent
pdecon_2 = Deconstruct(Point=sunpath.sun_pts)  # -> XComponent, YComponent, ZComponent
Z = UnitZ(Factor=1)
subtraction = Subtraction(A=pdecon_2.ZComponent, B=pdecon.ZComponent)
line = LineSDL(Start=sunpath.sun_pts, Direction=expr("-x", Z), Length=subtraction)
end = EndPoints(Curve=line)  # -> Start, End
data_3 = Data(sunpath.sun_pts)
data_4 = Data(end.End)
data_5 = Data(pcen.CenterA)
dash = DashPattern(Curve=line, Pattern="0.5,2")  # -> Dashes, Gaps
ln = Line(StartPoint=sunpath.sun_pts, EndPoint=pcen.CenterA)
ln_2 = Line(StartPoint=end.End, EndPoint=pcen.CenterA)
merge = Merge(Data1=ln, Data2=dash.Dashes)
filter_7 = StreamFilter(Gate=daily, Stream1=merge)

multiplication = Multiplication(A=scale, B=2)
msphere = MeshSphere(Base=sunpath.sun_pts, Radius=multiplication, UCount=10, VCount=20)
pt = Point(Point(0, 0, 0))
mspray = MeshSpray(Mesh=msphere, Points=pt, Colours=ColourSwatch(SwatchColor=RGB(255, 183, 0)), SprayMode=11)

# ---- group: Sun Angle
angle = Angle(VectorA=ln, VectorB=ln_2)  # -> Angle, Reflex
deg = Degrees(Radians=angle.Angle)

# ---- group: Round decimel
panel_6 = Panel("{0:0.0}")
format = Format(Format=panel_6, Culture=127, Data0=sunpath.altitudes)

# ----
item_4 = ListItem(List=sunpath.compass, Index=2, Wrap=True)
vec = Vector(ln_2)
altitudes = Panel(sunpath.altitudes)
azimuths = Panel(sunpath.azimuths)
outter_sunpath = Data(item_4)
data_6 = Data(pcen.CenterA)
points = PointList(Points=data_4, Size=100)
line_2 = LineSDL(Start=data_4, Direction=vec, Length=1000000)
format_2 = Format(Format=panel_6, Culture=127, Data0=sunpath.azimuths)
end_2 = EndPoints(Curve=line_2)  # -> Start, End
sunpt = Point(sunpath.sun_pts)
ccx = CurveCurve(CurveA=line_2, CurveB=outter_sunpath)  # -> Points, ParamsA, ParamsB
points_2 = PointList(Points=flatten(ccx.Points), Size=100)
ln_3 = Line(StartPoint=data_6, EndPoint=ccx.Points)
entwine = Entwine(
    Branch00=flatten(format),
    Branch01=flatten(sunpt),
    Branch02=flatten(format_2),
    Branch03=flatten(ccx.Points),
    Branch04=flatten(ln_3),
    FlattenInputs=True)

shadow_direct_hours = Entwine(Branch00=directsunhours.mesh, Branch01=directsunhours.legend, Branch02=directsunhours.title, FlattenInputs=True)
sunpath_2 = Entwine(
    Branch00=mspray,
    Branch01=sunpath.analemma,
    Branch02=sunpath.daily,
    Branch03=sunpath.compass,
    Branch04=sunpath.title,
    Branch05=sunpath.color_pts,
    Branch07=filter_7,
    FlattenInputs=True)
data_7 = Data(directsunhours.results)
directsun = ClusterOutput(shadow_direct_hours)
results = ClusterOutput(data_7)
R = ClusterOutput(sunpath_2)
daily_2 = ClusterOutput(sunpath.daily)
sundiagram = ClusterOutput(entwine)

# ==== cluster SortingSurfaces
top_bottom_inside = ClusterInput()  # 1/-1/0
brep = ClusterInput()  # 1/-1/0

# ---- group: Finding Top Surface
pl = PlaneNormal(Origin=Point(0, 0, 0), ZAxis=Vector(0, 0, 1))
debrep = DeconstructBrep(Brep=brep)  # -> Faces, Edges, Vertices
deplane = DeconstructPlane(Plane=pl)  # -> Origin, XAxis, YAxis, ZAxis
pdecon = Deconstruct(Point=deplane.ZAxis)  # -> XComponent, YComponent, ZComponent
md_slider = MDSlider(SliderMode=0, slider_value=Point(0.5, 0.5, 0.5), x_domain=Domain(0, 1), y_domain=Domain(0, 1), z_domain=Domain(0, 1))

# ----
evalsrf = EvaluateSurface(Surface=debrep.Faces, Point=md_slider)  # -> Point, Normal, UDirection, VDirection, Frame

# ---- group: Finding Top Surface (continued)
pdecon_2 = Deconstruct(Point=evalsrf.Normal)  # -> XComponent, YComponent, ZComponent

# ----
int = Integer(pdecon_2.ZComponent)

# ---- group: Finding Top Surface (continued)
equals = Equality(FirstNumber=top_bottom_inside, SecondNumber=int)  # -> Equality, Inequality
dispatch = Dispatch(List=debrep.Faces, DispatchPattern=equals.Equality)  # -> ListA, ListB

# ----
surfaces = ClusterOutput(dispatch.ListA)
