# Grasshopper definition 6ae7022f.gh (Grasshopper 1.0.8)
# plug-ins: MetaHopper, UiPlus, Sasquatch

# ----
# Opaque materials
panel = Panel("""[
  {
    "name": "Concrete",
    "type": "HB_RadianceOpaqueModifier",
    "diffuse_reflectance": 0.3,
    "specular_reflectance": 0.02,
    "roughness": 0.1
  },
  {
    "name": "Dark_Wood",
    "type": "HB_RadianceOpaqueModifier",
    "diffuse_reflectance": 0.25,
    "specular_reflectance": 0.05,
    "roughness": 0.3
  }
]""")
json_tree = Python3Script(json_in=panel)  # -> out, keys, tree, columns; inputs json_in: String
# ---------- json_tree: Python ----------
"""
Inputs  : json_in  (str) – either a file path OR the full JSON text
Outputs : tree     (DataTree[str]) – row-aligned data tree
          keys     (list[str])      – ordered list of column headers
          columns  (dict)           – column-wise lookup for later use
"""
import json, os
from Grasshopper import DataTree
from Grasshopper.Kernel.Data import GH_Path

# ---------- helper -----------------------------------------------------------
def load_json(src):
    """Return a Python list loaded from a filepath OR from raw JSON text."""
    src = src.strip()
    # Heuristic: looks like JSON text if it starts with { or [
    if src.startswith("{") or src.startswith("["):
        return json.loads(src)
    # Otherwise assume it is a path on disk
    if not os.path.isfile(src):
        raise ValueError("Input is neither JSON text nor a valid file-path.")
    with open(src, "r") as f:
        return json.load(f)

# ---------- main -------------------------------------------------------------
tree   = DataTree[str]()
keys   = []
columns = {}

if not json_in:
    raise ValueError("Connect JSON (text or path) to the 'json_in' input.")

data = load_json(json_in)

if not isinstance(data, list):
    raise ValueError("Top-level JSON should be a list of objects.")

# 1. fixed columns first
fixed = ["name", "type"]
dynamic = set()
for obj in data:
    if not isinstance(obj, dict):
        raise ValueError("Every item in the array must be a JSON object.")
    dynamic.update(k for k in obj.keys() if k not in fixed)

keys = fixed + sorted(dynamic)

# 2. initialise column dictionary
for k in keys:
    columns[k] = []

# 3. build the data tree + fill columns
for i, obj in enumerate(data):
    path = GH_Path(i)
    for k in keys:
        val = obj.get(k, "")   # empty string if key missing
        s   = str(val)
        tree.Add(s, path)
        columns[k].append(s)
# ---------- end json_tree ----------
panel_2 = Panel(json_tree.keys)
panel_3 = Panel(json_tree.tree)
item = ListItem(List=json_tree.tree, Index=0, Wrap=True)  # -> Item, Item1, Item2, Item3, Item4
item_2 = ListItem(List=json_tree.tree, Index=0, Wrap=True)  # -> flatten(Item)
item_3 = ListItem(List=json_tree.tree, Index=0, Wrap=True)  # -> flatten(Item)
reflect = Data(item.Item2)
spec = Data(item.Item4)
rough = Data(item.Item3)
panel_4 = Panel(item_2)

# ----
# Glass materials
panel_5 = Panel("""[
  { "name": "Glass_Clear", "trans": 0.85, "refract": 1.52 },
  { "name": "Glass_LowE", "trans": 0.60, "refract": 1.52 },
  { "name": "Glass_Tinted", "trans": 0.30, "refract": 1.52 }
]""")
json_tree_2 = Python3Script(json_in=panel_5)  # -> out, keys, tree, columns; inputs json_in: String; same code as json_tree
panel_6 = Panel(json_tree_2.keys)
panel_7 = Panel(json_tree_2.tree)
item_4 = ListItem(List=json_tree_2.tree, Index=0, Wrap=True)  # -> Item, Item1, Item2, Item3, Item4, Item5, Item6, Item7, Item8
item_5 = ListItem(List=json_tree_2.tree, Index=0, Wrap=True)  # -> flatten(Item)
item_6 = ListItem(List=json_tree_2.tree, Index=0, Wrap=True)  # -> flatten(Item)
panel_8 = Panel(item_5)

# ----
# Trans materials
panel_9 = Panel("""[
  {
    "name": "Frosted_Glass_Light",
    "diff_ref": 0.1,
    "diff_trans": 0.6,
    "spec_trans": 0.05,
    "spec": 0.01,
    "rough": 0.15
  },
  {
    "name": "Frosted_Glass_Medium",
    "diff_ref": 0.15,
    "diff_trans": 0.45,
    "spec_trans": 0.05,
    "spec": 0.0,
    "rough": 0.2
  },
  {
    "name": "Polycarbonate_Sheet",
    "diff_ref": 0.12,
    "diff_trans": 0.5,
    "spec_trans": 0.0,
    "spec": 0.01,
    "rough": 0.25
  },
  {
    "name": "Tree_Canopy_Leaf",
    "diff_ref": 0.25,
    "diff_trans": 0.3,
    "spec_trans": 0.0,
    "spec": 0.0,
    "rough": 0.3
  },
  {
    "name": "Fabric_Shade_White",
    "diff_ref": 0.65,
    "diff_trans": 0.15,
    "spec_trans": 0.0,
    "spec": 0.01,
    "rough": 0.25
  }
]""")
json_tree_3 = Python3Script(json_in=panel_9)  # -> out, keys, tree, columns; inputs json_in: String; same code as json_tree
panel_10 = Panel(json_tree_3.keys)
panel_11 = Panel(json_tree_3.tree)
item_7 = ListItem(List=json_tree_3.tree, Index=0, Wrap=True)  # -> Item, Item1, Item2, Item3, Item4, Item5, Item6, Item7, Item8
item_8 = ListItem(List=json_tree_3.tree, Index=0, Wrap=True)  # -> flatten(Item)
item_9 = ListItem(List=json_tree_3.tree, Index=0, Wrap=True)  # -> flatten(Item)
panel_12 = Panel(item_8)

transmission = Data(item_7.Item3)
reflect_2 = Data(item_7.Item2)
transmission_2 = Data(item_4.Item3)
reflect_3 = Data(item_4.Item2)

# ----
# Select GEO
dropdown_list = UiDropdownList(Values=panel_12, Index=0)
get_values = UiValues(Element=dropdown_list)
item_10 = ListItem(List=flatten(item_7.Item), Index=get_values, Wrap=True)
item_11 = ListItem(List=flatten(item_7.Item6), Index=get_values, Wrap=True)
item_12 = ListItem(List=flatten(item_7.Item2), Index=get_values, Wrap=True)
item_13 = ListItem(List=flatten(item_7.Item5), Index=get_values, Wrap=True)
item_14 = ListItem(List=flatten(item_7.Item3), Index=get_values, Wrap=True)
item_15 = ListItem(List=flatten(item_7.Item4), Index=get_values, Wrap=True)
transmod = HBTranslucentModifier(name=item_10, diff_ref=item_12, diff_trans=item_14, spec_trans=item_11, spec=item_13, rough=item_15)  # -> modifier; plug-in component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

# ----
# Select GEO
rh_sel_btn = UiRhinoSelectButton(Label="Geometry [Srf/Brep]", Filter=16)
get_values_2 = UIValues(Element=rh_sel_btn)
brep = Brep(get_values_2)
brep_2 = Brep(brep)
debrep = DeconstructBrep(Brep=brep_2)  # -> Faces, Edges, Vertices

dropdown_list_2 = UiDropdownList(Values=panel_12, Index=0)
get_values_3 = UiValues(Element=dropdown_list_2)
item_16 = ListItem(List=flatten(item_7.Item), Index=get_values_3, Wrap=True)
item_17 = ListItem(List=flatten(item_7.Item6), Index=get_values_3, Wrap=True)
item_18 = ListItem(List=flatten(item_7.Item2), Index=get_values_3, Wrap=True)
item_19 = ListItem(List=flatten(item_7.Item5), Index=get_values_3, Wrap=True)
item_20 = ListItem(List=flatten(item_7.Item3), Index=get_values_3, Wrap=True)
item_21 = ListItem(List=flatten(item_7.Item4), Index=get_values_3, Wrap=True)
transmod_2 = HBTranslucentModifier(name=item_16, diff_ref=item_18, diff_trans=item_20, spec_trans=item_17, spec=item_19, rough=item_21)  # -> modifier; plug-in component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

# ---- group: Srf Grid
rh_sel_btn_2 = UiRhinoSelectButton(Label="Analysis Grid [Srf]", Filter=16)
get_values_4 = UIValues(Element=rh_sel_btn_2)
srf = Surface(get_values_4)

# ----
check_box = UiCheckBox(Label="Preview Solid/Glass", State=True)

rh_sel_btn_3 = UiRhinoSelectButton(Label="Geometry [Srf/Brep]", Filter=16)
get_values_5 = UIValues(Element=rh_sel_btn_3)
brep_3 = Brep(get_values_5)
brep_4 = Brep(brep_3)
debrep_2 = DeconstructBrep(Brep=brep_4)  # -> Faces, Edges, Vertices

rh_sel_btn_4 = UiRhinoSelectButton(Label="Geometry [Srf/Brep]", Filter=16)
get_values_6 = UIValues(Element=rh_sel_btn_4)
brep_5 = Brep(get_values_6)
brep_6 = Brep(brep_5)
debrep_3 = DeconstructBrep(Brep=brep_6)  # -> Faces, Edges, Vertices

dropdown_list_3 = UiDropdownList(Values=panel_4, Index=0)
get_values_7 = UiValues(Element=dropdown_list_3)
item_22 = ListItem(List=flatten(item.Item), Index=get_values_7, Wrap=True)
rad = Panel(item_22)
item_23 = ListItem(List=flatten(spec), Index=get_values_7, Wrap=True)
item_24 = ListItem(List=flatten(rough), Index=get_values_7, Wrap=True)
item_25 = ListItem(List=flatten(reflect), Index=get_values_7, Wrap=True)
opaquemod = HBOpaqueModifier(name=item_22, reflect=item_25, spec=item_23, rough=item_24)  # -> modifier; plug-in component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

dropdown_list_4 = UiDropdownList(Values=panel_8, Index=0)
get_values_8 = UiValues(Element=dropdown_list_4)
item_26 = ListItem(List=flatten(item_4.Item), Index=get_values_8, Wrap=True)
item_27 = ListItem(List=flatten(transmission_2), Index=get_values_8, Wrap=True)
item_28 = ListItem(List=flatten(reflect_3), Index=get_values_8, Wrap=True)

rh_sel_btn_5 = UiRhinoSelectButton(Label="Geometry [Srf/Brep]", Filter=16)
get_values_9 = UIValues(Element=rh_sel_btn_5)
brep_7 = Brep(get_values_9)
brep_8 = Brep(brep_7)
debrep_4 = DeconstructBrep(Brep=brep_8)  # -> Faces, Edges, Vertices

dropdown_list_5 = UiDropdownList(Values=panel_4, Index=0)
get_values_10 = UiValues(Element=dropdown_list_5)
item_29 = ListItem(List=flatten(item.Item), Index=get_values_10, Wrap=True)
item_30 = ListItem(List=flatten(spec), Index=get_values_10, Wrap=True)
item_31 = ListItem(List=flatten(rough), Index=get_values_10, Wrap=True)
item_32 = ListItem(List=flatten(reflect), Index=get_values_10, Wrap=True)
opaquemod_2 = HBOpaqueModifier(name=item_29, reflect=item_32, spec=item_30, rough=item_31)  # -> modifier; plug-in component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
rad_2 = Panel(item_29)

rh_sel_btn_6 = UiRhinoSelectButton(Label="Geometry [Srf/Brep]", Filter=16)
get_values_11 = UIValues(Element=rh_sel_btn_6)
brep_9 = Brep(get_values_11)
brep_10 = Brep(brep_9)
debrep_5 = DeconstructBrep(Brep=brep_10)  # -> Faces, Edges, Vertices

rh_sel_btn_7 = UiRhinoSelectButton(Label="Geometry [Srf/Brep]", Filter=16)
get_values_12 = UIValues(Element=rh_sel_btn_7)
brep_11 = Brep(get_values_12)
brep_12 = Brep(brep_11)
debrep_6 = DeconstructBrep(Brep=brep_12)  # -> Faces, Edges, Vertices

dropdown_list_6 = UiDropdownList(Values=panel_8, Index=0)
get_values_13 = UiValues(Element=dropdown_list_6)
item_33 = ListItem(List=flatten(transmission_2), Index=get_values_13, Wrap=True)
item_34 = ListItem(List=flatten(item_4.Item), Index=get_values_13, Wrap=True)
item_35 = ListItem(List=flatten(reflect_3), Index=get_values_13, Wrap=True)

# ----
# Select GEO
dropdown_list_7 = UiDropdownList(Values=panel_4, Index=0)
get_values_14 = UiValues(Element=dropdown_list_7)
item_36 = ListItem(List=flatten(item.Item), Index=get_values_14, Wrap=True)
item_37 = ListItem(List=flatten(spec), Index=get_values_14, Wrap=True)
item_38 = ListItem(List=flatten(rough), Index=get_values_14, Wrap=True)
item_39 = ListItem(List=flatten(reflect), Index=get_values_14, Wrap=True)
opaquemod_3 = HBOpaqueModifier(name=item_36, reflect=item_39, spec=item_37, rough=item_38)  # -> modifier; plug-in component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
rad_3 = Panel(item_36)

rh_sel_btn_8 = UiRhinoSelectButton(Label="Geometry [Srf/Brep]", Filter=16)
get_values_15 = UIValues(Element=rh_sel_btn_8)
brep_13 = Brep(get_values_15)
brep_14 = Brep(brep_13)
debrep_7 = DeconstructBrep(Brep=brep_14)  # -> Faces, Edges, Vertices

get_values_16 = UIValues(Element=check_box)
glassmod = HBGlassModifier(name=item_34, trans=item_33, refract=item_35)  # -> modifier; plug-in component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
glassmod_2 = HBGlassModifier(name=item_26, trans=item_27, refract=item_28)  # -> modifier; plug-in component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

# ---- group: brep
entwine = Entwine(Branch00=debrep_3.Faces, Branch01=debrep_2.Faces, FlattenInputs=True)
clean = CleanTree(RemoveNulls=True, RemoveInvalid=True, RemoveEmpty=True, Tree=entwine)

entwine_2 = Entwine(Branch00=debrep_5.Faces, Branch01=debrep_6.Faces, Branch02=debrep_7.Faces, FlattenInputs=True)
clean_2 = CleanTree(RemoveNulls=True, RemoveInvalid=True, RemoveEmpty=True, Tree=entwine_2)

# ---- group: Rad
entwine_3 = Entwine(Branch00=transmod_2, Branch01=transmod, FlattenInputs=True)
clean_3 = CleanTree(RemoveNulls=True, RemoveInvalid=True, RemoveEmpty=True, Tree=entwine_3)

# ---- group: brep
entwine_4 = Entwine(Branch00=debrep_4.Faces, Branch01=debrep.Faces, FlattenInputs=True)
clean_4 = CleanTree(RemoveNulls=True, RemoveInvalid=True, RemoveEmpty=True, Tree=entwine_4)

# ---- group: Rad
entwine_5 = Entwine(Branch00=glassmod_2, Branch01=glassmod, FlattenInputs=True)
clean_5 = CleanTree(RemoveNulls=True, RemoveInvalid=True, RemoveEmpty=True, Tree=entwine_5)

entwine_6 = Entwine(Branch00=opaquemod, Branch01=opaquemod_2, Branch02=opaquemod_3, FlattenInputs=True)
clean_6 = CleanTree(RemoveNulls=True, RemoveInvalid=True, RemoveEmpty=True, Tree=entwine_6)

# ----
filter = StreamFilter(Gate=get_values_16, Stream1=entwine_4)

# ---- group: Preview
swatch = ColourSwatch(SwatchColor=RGBA(93, 187, 227, 180))
offset = OffsetSurface(Surface=entwine_4, Distance=Slider(0.001, range=0..0.001), Retrim=True)
preview = CustomPreview(Geometry=filter, Material=swatch)

# ----
linetype = ModelLinetype(Name="SolidEdge", Width=Slider(1, range=0..10))  # -> Linetype, Name, Segments, CapStyle, JoinStyle, Width, WidthUnits, ScalingStyle
curve_preview = CustomCurvePreview(Curve=filter, Linetype=linetype.Linetype, Colour=swatch)  # disabled

# ---- group: EPW DropDown List
epw_link_list_israel = Panel("""https://climate.onebuilding.org/WMO_Region_6_Europe/ISR_Israel/Z_HaTsafon/ISR_Z_Mahanaim-Pina.AP.401761_TMYx.zip
https://climate.onebuilding.org/WMO_Region_6_Europe/ISR_Israel/Z_HaTsafon/ISR_Z_Zefat.Har.Kenaan.MS.401530_TMYx.2004-2018.zip
https://climate.onebuilding.org/WMO_Region_6_Europe/ISR_Israel/Z_HaTsafon/ISR_Z_Haifa.AP.401550_TMYx.zip
https://climate.onebuilding.org/WMO_Region_6_Europe/ISR_Israel/Z_HaTsafon/ISR_Z_Ramat.David.AB.401650_TMYx.zip
https://climate.onebuilding.org/WMO_Region_6_Europe/SYR_Syrian_Arab_Republic/SYR_QU_Sweida-UNDOF.400670_TMYx.zip
https://climate.onebuilding.org/WMO_Region_6_Europe/ISR_Israel/M_HaMerkaz/ISR_M_Netanya.401730_TMYx.zip
https://climate.onebuilding.org/WMO_Region_6_Europe/ISR_Israel/TA_Tel-Aviv/ISR_TA_Tel.Aviv-Sde.Dov.AP.401762_TMYx.zip
https://climate.onebuilding.org/WMO_Region_6_Europe/ISR_Israel/TA_Tel-Aviv/ISR_TA_Tel.Aviv-Bet.Dagan.401790_TMYx.zip
https://climate.onebuilding.org/WMO_Region_6_Europe/ISR_Israel/TA_Tel-Aviv/ISR_TA_Tel.Aviv-Ben.Gurion.Intl.AP.401800_TMYx.zip
https://climate.onebuilding.org/WMO_Region_6_Europe/ISR_Israel/JM_Yerushalayim/ISR_JM_Jerusalem.Center.401830_TMYx.2004-2018.zip
https://climate.onebuilding.org/WMO_Region_6_Europe/PSE_Palestine/PSE_WBK_Hebron.402400_TMYx.zip
https://climate.onebuilding.org/WMO_Region_6_Europe/PSE_Palestine/PSE_GZZ_Gaza.623380_TMYx.zip
https://climate.onebuilding.org/WMO_Region_6_Europe/PSE_Palestine/PSE_GZZ_Yasser.Arafat.Intl.AP-Gaza.Intl.AP.402300_TMYx.zip
https://climate.onebuilding.org/WMO_Region_6_Europe/ISR_Israel/D_HaDarom/ISR_D_Beer.Sheva-Teyman.AP.401910_TMYx.zip
https://climate.onebuilding.org/WMO_Region_6_Europe/ISR_Israel/D_HaDarom/ISR_D_Beer.Sheva.401900_TMYx.zip
https://climate.onebuilding.org/WMO_Region_6_Europe/ISR_Israel/D_HaDarom/ISR_D_Ovda.AP.401980_TMYx.zip
https://climate.onebuilding.org/WMO_Region_6_Europe/ISR_Israel/D_HaDarom/ISR_D_Eilat-Hozman.AP.401990_TMYx.zip""")
split = TextSplit(Text=epw_link_list_israel, Separators="/")
item_40 = ListItem(List=reverse(split), Index=0, Wrap=True)
split_2 = TextSplit(Text=item_40, Separators="_")
item_41 = ListItem(List=split_2, Index=2, Wrap=True)  # -> flatten(Item)
dropdown_list_8 = UiDropdownList(Values=item_41, Index=7)
get_values_17 = UIValues(Element=dropdown_list_8)
item_42 = ListItem(List=epw_link_list_israel, Index=get_values_17, Wrap=True)

# ----
# Run
panel_13 = Panel("Run")
button = UiButton(Label=panel_13)
get_values_18 = UiValues(Element=button)
bool = Boolean(get_values_18)
reset_button = Python3Script(x=bool)  # -> out, a
# ---------- reset_button: Python ----------
import Grasshopper as gh

# Make 'previous' persist across script executions
global previous
try:
    previous
except NameError:
    previous = False

# Default output
pulse = False

# Detect a rising edge: (x == True) AND (previous == False)
if x and not previous:
    pulse = True
    # Schedule an immediate re-calculation to reset output
    doc = ghenv.Component.OnPingDocument()
    if doc:
        doc.ScheduleSolution(1, lambda d: ghenv.Component.ExpireSolution(False))

# Store the current state for next run
previous = x

# Output the one-shot pulse
a = pulse
# ---------- end reset_button ----------

panel_14 = Panel(reset_button.a)
bool_2 = Boolean(panel_14)

panel_15 = Panel("Display Sky Matrix")  # disabled
check_box_2 = UiCheckBox(Label=panel_15, State=False)  # disabled
get_values_19 = UiValues(Element=check_box_2)  # disabled

# ---- group: North rotate
dom = ConstructDomain(DomainStart="0", DomainEnd="360")
slider = UISlider(Label="North", Value=Slider(0, range=0..360), Bounds=dom, Increment=Slider(1, range=0..1))
get_values_20 = UiValues(Element=slider)

# ----
panel_16 = Panel("""-------------------------------------------------------------------------------
Analysis period- Start to End""")
list = ValueList({"Body": 0, "Bold": 1, "Title": 2, "Subtitle": 3, "Subtext": 4}, selected="Body")
label = UILabel(Label=panel_16, Style=list)

panel_17 = Panel("accurately models direct sun by tracing rays from each sensor to the solar position at each hour of the calculation. This makes the result suitable for computing Annual Sun Exposure (ASE)")
text_block = UITextBlock(Text=panel_17)

number_slider = Slider(0.5, range=0..1)  # disabled
panel_18 = Panel("1")  # disabled
panel_19 = Panel("0")  # disabled
panel_20 = Panel("31")  # disabled
panel_21 = Panel("12")  # disabled
panel_22 = Panel("0")  # disabled
panel_23 = Panel("31")  # disabled
panel_24 = Panel("12")  # disabled
panel_25 = Panel("1")  # disabled
panel_26 = Panel("0")  # disabled
panel_27 = Panel("0")  # disabled
panel_28 = Panel("23")  # disabled
panel_29 = Panel("23")  # disabled
text_block_2 = UITextBlock(Text="Annual Daylight")
units_check = GhPythonScript()
# ---------- units_check: Python ----------
import rhinoscriptsyntax as rs
import Rhino
import scriptcontext as sc
from System.Windows.Forms import MessageBox

# Get the active Rhino document
doc = Rhino.RhinoDoc.ActiveDoc

# Check if the document is not using meters as the unit
if doc.ModelUnitSystem != Rhino.UnitSystem.Meters:
    # Display a popup message with additional instructions
    MessageBox.Show(
        "Warning: Rhino document units are not set to meters.\n\n"
        "Please close Rhino completely, reopen it, change the units to Meters, "
        "and only then open the Grasshopper file.",
        "Units Check"
    )
# ---------- end units_check ----------
panel_30 = Panel(get_values_18)
font = UiSetFont(Element=[text_block_2, button], Family="Rajdhani", Size=20, Bold=True)
record = RecordData(Data=reset_button.a, Record=True, Reset=False, RecordFirstDataOnReset=True)
panel_31 = Panel(reset_button.a)
rh_sel_btn_9 = UiRhinoSelectButton(Label="Room [Aperture]", Filter=16)
rh_sel_btn_10 = UiRhinoSelectButton(Label="Context", Filter=16)
panel_32 = Panel(record)
get_values_21 = UIValues(Element=rh_sel_btn_9)
brep_15 = Brep(get_values_21)
get_values_22 = UIValues(Element=rh_sel_btn_10)
panel_33 = Panel("""0
1
2""")
panel_34 = Panel("""0
0
0""")
brep_16 = Brep(get_values_22)
panel_35 = Panel("""0
0
0""")
panel_36 = Panel("""0
1
2""")
panel_37 = Panel(item_42)
panel_38 = Panel("""0
0
0""")
panel_39 = Panel("""0
1
2""")
button_2 = UiButton(Label="Visit Archidemy")
button_3 = UiButton(Label="Contact Us")
panel_40 = Panel("""0
1""")
panel_41 = Panel("""0
0""")
merge = Merge(Data1=flatten(button_2), Data2=flatten(button_3))
panel_42 = Panel("""0
0""")
panel_43 = Panel("""0
1""")
grid = UiGridLayout(Elements=merge, Columns=panel_43, Rows=panel_42)
spacer = UiSpacer(Width=10, Horizontal=False)
spacer_2 = UiSpacer(Width=10, Horizontal=False)
spacer_3 = UiSpacer(Width=10, Horizontal=False)
spacer_4 = UiSpacer(Width=10, Horizontal=False)
merge_2 = Merge(
    Data1=flatten(dropdown_list_4),
    Data2=flatten(rh_sel_btn_5),
    Data3=flatten(spacer_3),
    Data4=flatten(dropdown_list_6),
    Data5=flatten(rh_sel_btn),
    Data6=flatten(spacer_4))
merge_3 = Merge(
    Data1=flatten(dropdown_list_3),
    Data2=flatten(rh_sel_btn_6),
    Data3=flatten(spacer_2),
    Data4=flatten(dropdown_list_5),
    Data5=flatten(rh_sel_btn_7),
    Data6=flatten(spacer),
    Data7=flatten(dropdown_list_7),
    Data8=flatten(rh_sel_btn_8))
grid_2 = UiGridLayout(Elements=merge_3, Columns=panel_40, Rows=panel_41)
merge_4 = Merge(Data1=flatten(check_box_2))

# ---- group: Opaque Faces
geo = Geometry(<extrusion referenced from the Rhino model>)
roomsolid = HBRoomFromSolid(geo=flatten(geo), name="TestRoom", conditioned=True)  # -> report, rooms; plug-in component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

# ---- group: Apertures
glassmod_3 = HBGlassModifier(name="g_material", trans="0.55")  # -> modifier; plug-in component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
brep_17 = Brep(<brep referenced from the Rhino model>)
aperture = HBAperture(geo=brep_17, rad_mod=glassmod_3)  # -> report, apertures; plug-in component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
addsubface = HBAddSubface(hb_obj=flatten(roomsolid.rooms), sub_faces=flatten(aperture.apertures))  # -> hb_obj; plug-in component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
bordershades = HBExtrudedBorderShades(hb_objs=flatten(addsubface), depth="0.3")  # -> report, hb_objs; plug-in component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

# ----
card = UiCardLayout(Elements=merge_3, Title="Solid Geometry")

card_2 = UiCardLayout(Elements=merge_2, Title="Glass Geometry")

card_3 = UiCardLayout(Elements=merge_4, Title="Display")

card_4 = UiCardLayout(Elements=button, Title="Run")

list_2 = ValueList({"Left": 0, "Center": 1, "Right": 2, "Stretch": 3}, selected="Stretch")
resize = UiResize(Element=[rh_sel_btn_6, dropdown_list_3, merge_3, merge_2], Alignment=list_2)

opaquemod_4 = HBOpaqueModifier(name="wood", reflect="0.45", spec="0.05", rough="0.1")  # -> modifier; plug-in component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
decnstrmod = HBDeconstructModifier(mod=opaquemod_4)  # -> rad_str; plug-in component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
panel_44 = Panel(opaquemod_4)
applyfacemod = HBApplyFaceModifier()  # -> hb_objs; plug-in component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
panel_45 = Panel(decnstrmod)
data = Data(panel_44)
srf_2 = Surface(<surface referenced from the Rhino model>)
panel_46 = Panel("0.5")
beam = Brep([<brep referenced from the Rhino model> x7])
wall = Brep([<brep referenced from the Rhino model> x4])
sensorgrid = HBSensorGrid(base_geo=srf_2)  # -> grid; plug-in component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
glassmod_4 = HBGlassModifier(name="g_material", trans="0.55")  # -> modifier; plug-in component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
brep_18 = Brep(<brep referenced from the Rhino model>)
debrep_8 = DeconstructBrep(Brep=beam)  # -> Faces, Edges, Vertices
debrep_9 = DeconstructBrep(Brep=wall)  # -> Faces, Edges, Vertices
face = HBFace(geo=debrep_8.Faces)  # -> report, faces; plug-in component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
aperture_2 = HBAperture(geo=brep_18, rad_mod=glassmod_4)  # -> report, apertures; plug-in component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
entwine_7 = Entwine(Branch00=debrep_9.Faces, FlattenInputs=True)
applyfacemod_2 = HBApplyFaceModifier(hb_objs=flatten(face.faces), mod=data)  # -> hb_objs; plug-in component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
face_2 = HBFace(geo=entwine_7)  # -> report, faces; plug-in component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
panel_47 = Panel(face_2.report)
model = HBModel(faces=flatten([face_2.faces, applyfacemod_2]))  # -> report, model; plug-in component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
# Geometry Preparation
number_slider_2 = Slider(0, range=0..10)

legendpar = LBLegendParameters(num_decimals="0")  # -> leg_par; plug-in component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

subtraction = Subtraction(B=30)
Y = UnitY(Factor=number_slider_2)

# ----
# Settings
panel_48 = Panel("""Low Res Grid [Faster] 5m
Mid Res Grid 1m
High Res Grid 0.5m
Ultra Res Grid [Slower] 0.3m
Hyper Res Grid [Slowest] 0.1m""")
panel_49 = Panel("""5
1
0.5
0.3
0.1""")

# ---- group: Res Grid
dropdown_list_9 = UiDropdownList(Values=panel_48, Index=2)

# ----
get_values_23 = UiValues(Element=dropdown_list_9)
item_43 = ListItem(List=panel_49, Index=get_values_23, Wrap=True)
panel_50 = Panel(item_43)

merge_5 = Merge(
    Data1=flatten(dropdown_list_8),
    Data2=flatten(slider),
    Data3=flatten(dropdown_list_9),
    Data4=flatten(rh_sel_btn_2),
    Data5=flatten(check_box))

card_5 = UiCardLayout(Elements=merge_5, Title="Analysis Settings")

spacer_5 = UiSpacer(Width=10, Horizontal=False)
merge_6 = Merge(
    Data1=flatten(card),
    Data2=flatten(card_2),
    Data3=flatten(spacer_5),
    Data4=flatten(card_5),
    Data5=flatten(spacer_5),
    Data6=flatten(card_3),
    Data7=flatten(card_4))
panel_51 = Panel(merge_6)
lng = ListLength(List=merge_6)
merge_7 = Merge(Data1=flatten(merge_6))
dup = DuplicateData(Data="Design Performance", Number=lng, Order=True)
tab = UiTabbedLayout(Elements=merge_7, Names=dup)

merge_8 = Merge(
    Data1=flatten(card),
    Data2=flatten(card_2),
    Data3=flatten(card_4),
    Data4=flatten(card_5),
    Data5=flatten(card_3),
    Data6=flatten(rh_sel_btn_2))
swatch_2 = ColourSwatch(SwatchColor=RGB(224, 224, 224))
graphics = UiSetGraphics(
    Element=merge_8,
    PrimaryColor=ColourSwatch(SwatchColor=RGB(0, 0, 0)),
    AccentColor=ColourSwatch(SwatchColor=RGB(255, 255, 255)),
    StrokeColor=ColourSwatch(SwatchColor=RGB(237, 237, 237)),
    StrokeWeight=0)
graphics_2 = UiSetGraphics(
    Element=[dropdown_list_3, merge_3, merge_2, rh_sel_btn_2],
    PrimaryColor=ColourSwatch(SwatchColor=RGB(84, 83, 83)),
    AccentColor=swatch_2,
    StrokeColor=swatch_2,
    StrokeWeight=0)

# ---- group: Preview
swatch_3 = ColourSwatch(SwatchColor=RGBA(255, 196, 0, 180))
offset_2 = OffsetSurface(Surface=entwine_2, Distance=Slider(0.001, range=0..0.001), Retrim=True)

# ----
edges = BrepEdges(Brep=offset_2)  # -> Naked, Interior, NonManifold
join = JoinCurves(Curves=edges.Naked, Preserve=False)
filter_2 = StreamFilter(Gate=get_values_16, Stream1=join)

# ---- group: Preview (continued)
preview_2 = CustomPreview(Geometry=filter_2, Material=swatch_3)  # disabled

# ----
curve_preview_2 = CustomCurvePreview(Curve=filter_2, Linetype=linetype.Linetype, Colour=swatch_3)

dam = DataDam(DataBrepOpaque=clean_2, BufferDelay=10000000, BufferMode=0)
dam_2 = DataDam(DataRadOpaque=clean_6, BufferDelay=10000000, BufferMode=0)
dam_3 = DataDam(DataBrepGlass=clean, BufferDelay=10000000, BufferMode=0)
dam_4 = DataDam(DataSunScale=srf, BufferDelay=10000000, BufferMode=0)
dam_5 = DataDam(DataBrepGlass=clean_4, BufferDelay=10000000, BufferMode=0)
dam_6 = DataDam(DataRadGlass=clean_3, BufferDelay=10000000, BufferMode=0)
dam_7 = DataDam(DataRadGlass=clean_5, BufferDelay=10000000, BufferMode=0)
dam_8 = DataDam(DataResGrid=item_43, BufferDelay=10000000, BufferMode=0)
dam_9 = DataDam(DataRoom=brep_15, BufferDelay=10000000, BufferMode=0)
dam_10 = DataDam(DataNorth=get_values_20, BufferDelay=10000000, BufferMode=0)
dam_11 = DataDam(DataEPW=item_42, BufferDelay=10000000, BufferMode=0)
objfromgroup = GetObjectsInGroup()

panel_52 = Panel(dam_7)
panel_53 = Panel(dam_2)

# ---- group: Grid
srf_3 = Surface(dam_4)
face_3 = HBFace(geo=srf_3, name="Floor", type="Floor")  # -> report, faces; plug-in component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
gridfaces = HBSensorGridFromFaces(hb_objs=face_3.faces, grid_size=dam_8, face_type=Slider(3, range=0..10))  # -> grid, points, mesh; plug-in component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

# ---- group: Trans
face_4 = HBFace(geo=dam_3)  # -> report, faces; plug-in component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
applyfacemod_3 = HBApplyFaceModifier(hb_objs=flatten(face_4.faces), mod=dam_6)  # -> hb_objs; plug-in component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
panel_54 = Panel(face_4.faces)

# ---- group: Glass
face_5 = HBFace(geo=dam_5)  # -> report, faces; plug-in component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
applyfacemod_4 = HBApplyFaceModifier(hb_objs=flatten(face_5.faces), mod=dam_7)  # -> hb_objs; plug-in component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
panel_55 = Panel(face_5.faces)

# ---- group: Solid
face_6 = HBFace(geo=dam)  # -> report, faces; plug-in component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
applyfacemod_5 = HBApplyFaceModifier(hb_objs=flatten(face_6.faces), mod=dam_2)  # -> hb_objs; plug-in component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
panel_56 = Panel(face_6.faces)

# ----
item_44 = ListItem(List=flatten(applyfacemod_5), Index=0, Wrap=True)

authorization_v3_0_3_limit_vercel = Python3Script(toggle=item_44)  # -> out, a
# ---------- authorization_v3_0_3_limit_vercel: Python ----------
import clr 
import Rhino
import json

clr.AddReference("System")
from System.Net import WebClient, WebException, WebExceptionStatus, HttpWebResponse

# Node.js server URL
AUTH_URL = "https://architool-v3-server.vercel.app/authorize"

def check_authorization(serial_number):
    """
    Checks authorization by querying the Node.js server with the given serial number.
    
    Parameters:
        serial_number (str): The Rhino serial number.

    Returns:
        tuple: (authorized (bool), message (str), return_value (int))
               When authorized, return_value is the remaining daily uses.
               When an error occurs, return_value is an error code:
                   20 = Internet connection error
                   30 = Server connection error
                   40 = JSON parsing error
                   50 = Unexpected error
                   60 = Unauthorized access error
    """
    try:
        # Build the full URL with query parameter
        url = "{}?serialNumber={}".format(AUTH_URL, serial_number)
        wc = WebClient()
        response_data = wc.DownloadString(url)
        
        # Parse the JSON response
        data = json.loads(response_data)
        authorized = data.get('authorized', False)
        message = data.get('message', "No message").strip()
        remaining_uses = data.get('remainingUses', 0)
        
        return authorized, message, remaining_uses
    
    except WebException as web_ex:
        # If the exception has a response, we try to inspect it for status code details
        if web_ex.Response is not None:
            http_response = web_ex.Response
            # Ensure we have an HttpWebResponse to extract status code information
            if isinstance(http_response, HttpWebResponse):
                status_code = int(http_response.StatusCode)
                if status_code in (401, 403):
                    return False, "Error: Unauthorized access.", 60
        # Differentiate between internet connection issues and server issues
        if web_ex.Status in (WebExceptionStatus.ConnectFailure, 
                             WebExceptionStatus.NameResolutionFailure, 
                             WebExceptionStatus.ProxyNameResolutionFailure):
            return False, "Error: Internet connection problem. Please check your network connection.", 20
        else:
            return False, "Error: Problem connecting to the server.", 30

    except ValueError as json_err:
        return False, "Error: JSON parsing error: " + str(json_err), 40
    except Exception as e:
        return False, "Error: Unexpected error: " + str(e), 50

def process_authorization(toggle):
    """
    Processes the authorization check based on the toggle value.

    Parameters:
        toggle (bool): If True, perform the authorization check; if False, skip it.
    """
    if not toggle:
        print("Toggle is set to False. Skipping authorization check.")
        print("0")
        return

    # Get the Rhino serial number; check if valid
    serial_number = Rhino.RhinoApp.SerialNumber
    if not serial_number:
        print("Error: Could not retrieve the Rhino serial number. Please ensure Rhino is properly licensed.")
        print("10")
        return

    authorized, message, code = check_authorization(serial_number)

    # Handle the response based on the return code
    if authorized:
        print("Active Educational License")
        print("Remaining Daily Uses: {}".format(code))
        print("1")
    elif "daily usage limit reached" in message.lower():
        print("Error: Daily limit for your educational license has been reached.")
        print("Please contact support at info@01Architecture.com for assistance.")
        print("3")
    else:
        # For error cases, print the error message and its corresponding error code
        print(message)
        print(code)

if __name__ == "__main__":
    toggle = True  # Change this based on your Grasshopper input
    process_authorization(toggle)
    print("01A_ArchiTools V3.0.3")
# ---------- end authorization_v3_0_3_limit_vercel ----------
item_45 = ListItem(List=authorization_v3_0_3_limit_vercel.out, Index=0, Wrap=True)  # -> Item2, Item1, Item
item_46 = ListItem(List=authorization_v3_0_3_limit_vercel.out, Index=0, Wrap=True)  # -> Item2, Item1, Item, Item1_2
panel_57 = Panel(authorization_v3_0_3_limit_vercel.out)
autorized = Data(item_46.Item2)
equals = Equality(FirstNumber=autorized, SecondNumber=1)  # -> Equality, Inequality
filter_3 = StreamFilter(Gate=equals.Equality, Stream0=item_46.Item2)
autorized_2 = Data(item_45.Item2)
panel_58 = Panel(item_46.Item1_2)
concat = Concatenate(FragmentA=item_46.Item, FragmentC=" ", FragmentB=filter_3)
panel_59 = Panel(concat)
log = Result([concat, item_46.Item1_2])

filter_4 = StreamFilter(Gate=autorized_2, Stream1=applyfacemod_4)
filter_5 = StreamFilter(Gate=autorized_2, Stream1=applyfacemod_5)
filter_6 = StreamFilter(Gate=autorized_2, Stream1=applyfacemod_3)
model_2 = HBModel(faces=flatten([filter_5, filter_4, filter_6]))  # -> report, model; plug-in component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
assigngridsviews = HBAssignGridsAndViews(model=model_2.model, grids=flatten(gridfaces.grid))  # -> model; plug-in component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
filter_7 = StreamFilter(Gate=autorized_2, Stream1=bool_2)

lng_2 = ListLength(List=objfromgroup)
dup_2 = DuplicateData(Data=filter_7, Number=lng_2, Order=True)
setobj = SetObjectValue(ObjectToSet=objfromgroup, ValueToSet=dup_2)

# ---- group: Context!
brep_19 = Brep([<brep referenced from the Rhino model> x2])
shade = HBShade(geo=dam)  # -> report, shades; disabled; plug-in component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

# ----
opening = Data(dam_2)

# ----
# Model + Grids
panel_60 = Panel("sample_model_grid")
model_3 = HBModel(rooms=flatten(bordershades.hb_objs), shades=flatten(shade.shades), name=panel_60)  # -> report, model; plug-in component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
gridrooms = HBSensorGridFromRooms(rooms=bordershades.hb_objs, grid_size=Slider(3, range=0..10))  # -> grid, points, mesh; plug-in component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
vizwiref = HBVisualizeWireframe(hb_objs=flatten(model_3.model))  # -> geo; plug-in component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

# ----
# Wea
# https://energyplus-weather.s3.amazonaws.com/north_and_central_america_wmo_region_4/USA/MA/USA_MA_Boston-Logan.Intl.AP.725090_TMY3/USA_MA_Boston-Logan.Intl.AP.725090_TMY3.zip
downloadepw = LBDownloadWeather(weather_URL=dam_11)  # -> epw_file, stat_file, ddy_file; plug-in component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
wea = HBWeaFromEPW(epw_file=downloadepw.epw_file)  # -> wea; plug-in component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

importepw = LBImportEPW(epw_file=downloadepw.epw_file)  # -> location, dry_bulb_temperature, dew_point_temperature, relative_humidity, wind_speed, wind_direction, direct_normal_rad, diffuse_horizontal_rad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; plug-in component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
sunpath = LBSunPath(north=dam_10, location=importepw.location, scale=1)  # -> report, vectors, altitudes, azimuths, hoys, sun_pts, analemma, daily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; plug-in component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
assigngridsviews_2 = HBAssignGridsAndViews(model=model_3.model, grids=flatten(gridrooms.grid))  # -> model; plug-in component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

# ----
# Run Recipe
toggle = BooleanToggle(True)
annualdaylight = HBAnnualDaylight(model=assigngridsviews, wea=wea, north=dam_10, enhanced=toggle, run=Toggle(True))  # -> report, results, DA, cDA, UDI, UDI_low, UDI_up; plug-in component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

assigngridsviews_3 = HBAssignGridsAndViews(model=model.model, grids=flatten(gridfaces.grid))  # -> model; plug-in component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
panel_61 = Panel(annualdaylight.DA)

# ----
# Compute sDA
sda = HBSpatialDaylightAutonomy(DA=annualdaylight.DA)  # -> report, sDA, pass_fail; plug-in component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
sda_in_each_room = Panel(sda.sDA)

# ----
# Visualize Daylight Autonomy
mjoin = MeshJoin(Meshes=gridfaces.mesh)
data_2 = Data(flatten(annualdaylight.DA))
heatmap = LBSpatialHeatmap(values=data_2, mesh=mjoin, legend_title="%")  # -> mesh, legend, title, colors, legend_par, vis_set; plug-in component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

bbox = BoundingBox(Content=mjoin, Plane=PlaneXY(0, 0, 0))  # -> Box, Box_2

# ----
# Visualize Hourly
# Illuminance for
# a Sensor
panel_62 = Panel("60")
pt = Point(gridfaces.points)
data_3 = Data(annualdaylight.results)
bang = ExplodeTree(Data=pt)  # -> Branch0, Branch1
item_47 = ListItem(List=bang.Branch0, Index=panel_62, Wrap=True)
sph = Sphere(Base=item_47, Radius="0.5")
annualtodata = HBAnnualResultsToData(results=flatten(data_3), sel_pts=flatten(item_47), all_pts=pt)  # -> report, data; plug-in component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
hourlyplot = LBHourlyPlot(data=annualtodata.data, base_pt="50,0,0", legend_par=legendpar)  # -> report, mesh, legend, borders, labels, title, vis_set; plug-in component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

null = NullItem(Item=sda.sDA)  # -> NullFlags, InvalidFlags, Description
debrep_10 = DeconstructBrep(Brep=bbox.Box)  # -> Faces, Edges, Vertices
pdecon = Deconstruct(Point=debrep_10.Vertices)  # -> XComponent, YComponent, ZComponent
multiplication = Multiplication(A=sda.sDA, B=100)
sort = SortList(Keys=pdecon.ZComponent, ValuesA=debrep_10.Vertices)  # -> Keys, ValuesA
int = Integer(multiplication)
item_48 = ListItem(List=sort.ValuesA, Index=[0, 1, 2, 3], Wrap=True)
pdecon_2 = Deconstruct(Point=item_48)  # -> XComponent, YComponent, ZComponent
concat_2 = Concatenate(FragmentC="sDA", FragmentD=" ", FragmentA=int, FragmentB="%")
sort_2 = SortList(Keys=pdecon_2.XComponent, ValuesA=item_48)  # -> Keys, ValuesA
filter_8 = StreamFilter(Gate=null.InvalidFlags, Stream0=concat_2)
item_49 = ListItem(List=sort_2.ValuesA, Index=0, Wrap=True)
move = Move(Geometry=item_49, Motion=Y)  # -> Geometry, Transform
tag = TextTag(Location=move.Geometry, Text=filter_8)
text_block_3 = UITextBlock(Text=item_45.Item)  # disabled
merge_9 = Merge(Data1=flatten(text_block_2), Data2=flatten(text_block), Data3=flatten(text_block_3), Data4=flatten(tab))
font_2 = UiSetFont(Element=merge_9, Family="Rajdhani")

pt_2 = Point(Point(0, 0, 0))
pt_3 = ConstructPoint(XCoordinate=Slider(75, range=0..200), YCoordinate=Slider(51, range=0..500), ZCoordinate=0)
window = UIWindow(Elements=merge_9, Title="ArchiTool V3.0", Owner=2, Scroll=True, Launch=Toggle(True))
modify_win = UiModifyWindow(Window=window, Position=pt_3, HideControls=True, HideTitle=True)

# ---- group: Sun Scale
number_slider_3 = Slider(1, range=0.1..20)  # disabled
number_slider_4 = Slider(10, range=0..10)  # disabled
number_slider_5 = Slider(0.5, range=0..1)  # disabled
panel_63 = Panel("Sun Scale")  # disabled
dom_2 = ConstructDomain(DomainStart=number_slider, DomainEnd=number_slider_4)  # disabled

# ----
slider_2 = UISlider(Label=panel_63, Value=number_slider_3, Bounds=dom_2, Increment=number_slider_5)  # disabled

# ---- group: Sun Scale (continued)
get_values_24 = UiValues(Element=slider_2)  # disabled

# ----
dam_12 = DataDam(DataSunScale=get_values_24, BufferDelay=10000000, BufferMode=0)

list_3 = ValueList({"Left": 0, "Center": 1, "Right": 2, "Stretch": 3}, selected="Stretch")
resize_2 = UiResize(Element=[dropdown_list_8, rh_sel_btn_6, rh_sel_btn_10, dropdown_list_9, slider_2, slider, button], Alignment=list_3)

# ---- group: Start Day
number_slider_6 = Slider(1, range=0..10)  # disabled
number_slider_7 = Slider(8, range=0..23)  # disabled
toggle_2 = BooleanToggle(True)  # disabled
panel_64 = Panel("End Day (1-31)")  # disabled
dom_3 = ConstructDomain(DomainStart=panel_19, DomainEnd=panel_20)  # disabled

# ----
scroll_integer = UIScrollInteger(Integer=number_slider_7, Wrap=toggle_2, Increment=number_slider_6, Bounds=dom_3)  # disabled

# ---- group: Start Day (continued)
get_values_25 = UiValues(Element=scroll_integer)  # disabled
panel_65 = Panel(get_values_25)  # disabled

# ---- group: Start Month
number_slider_8 = Slider(1, range=0..10)  # disabled
number_slider_9 = Slider(1, range=1..12)  # disabled
toggle_3 = BooleanToggle(True)  # disabled
panel_66 = Panel("End Month (1-12)")  # disabled
dom_4 = ConstructDomain(DomainStart=panel_25, DomainEnd=panel_24)  # disabled

# ----
scroll_integer_2 = UIScrollInteger(Integer=number_slider_9, Wrap=toggle_3, Increment=number_slider_8, Bounds=dom_4)  # disabled

# ---- group: Start Month (continued)
get_values_26 = UiValues(Element=scroll_integer_2)  # disabled
panel_67 = Panel(get_values_26)  # disabled

number_slider_10 = Slider(1, range=0..10)  # disabled
number_slider_11 = Slider(1, range=1..12)  # disabled
toggle_4 = BooleanToggle(True)  # disabled
panel_68 = Panel("Start Month (1-12)")  # disabled
dom_5 = ConstructDomain(DomainStart=panel_18, DomainEnd=panel_21)  # disabled

# ----
scroll_integer_3 = UIScrollInteger(Integer=number_slider_11, Wrap=toggle_4, Increment=number_slider_10, Bounds=dom_5)  # disabled

# ---- group: Start Month (continued)
get_values_27 = UiValues(Element=scroll_integer_3)  # disabled
panel_69 = Panel(get_values_27)  # disabled

# ---- group: Start Hour Time
panel_70 = Panel("Start Hour(0-23)")  # disabled
number_slider_12 = Slider(1, range=0..10)  # disabled
number_slider_13 = Slider(8, range=0..23)  # disabled
toggle_5 = BooleanToggle(True)  # disabled
dom_6 = ConstructDomain(DomainStart=panel_27, DomainEnd=panel_29)  # disabled

# ----
scroll_integer_4 = UIScrollInteger(Integer=number_slider_13, Wrap=toggle_5, Increment=number_slider_12, Bounds=dom_6)  # disabled

# ---- group: Start Hour Time (continued)
get_values_28 = UiValues(Element=scroll_integer_4)  # disabled
panel_71 = Panel(get_values_28)  # disabled

# ---- group: Start Day
number_slider_14 = Slider(1, range=0..10)  # disabled
number_slider_15 = Slider(8, range=0..23)  # disabled
toggle_6 = BooleanToggle(True)  # disabled
panel_72 = Panel("Start Day (1-31)")  # disabled
dom_7 = ConstructDomain(DomainStart=panel_22, DomainEnd=panel_23)  # disabled

# ----
scroll_integer_5 = UIScrollInteger(Integer=number_slider_15, Wrap=toggle_6, Increment=number_slider_14, Bounds=dom_7)  # disabled

# ---- group: Start Day (continued)
get_values_29 = UiValues(Element=scroll_integer_5)  # disabled
panel_73 = Panel(get_values_29)  # disabled

# ----
merge_10 = Merge(Data1=flatten(panel_70), Data2=flatten(panel_72), Data3=flatten(panel_68))
merge_11 = Merge(Data1=flatten(scroll_integer_4), Data2=flatten(scroll_integer_5), Data3=flatten(scroll_integer_3))

panel_74 = Panel(merge_10)
list_4 = ValueList({"Body": 0, "Bold": 1, "Title": 2, "Subtitle": 3, "Subtext": 4}, selected="Body")
label_2 = UILabel(Label=merge_10, Style=list_4)

grid_3 = UiGridLayout(Elements=merge_11, Columns=panel_36, Rows=panel_35)
grid_4 = UiGridLayout(Elements=label_2, Columns=panel_36, Rows=panel_35)

# ---- group: End Hour Time
number_slider_16 = Slider(1, range=0..10)  # disabled
number_slider_17 = Slider(8, range=0..23)  # disabled
toggle_7 = BooleanToggle(True)  # disabled
panel_75 = Panel("End Hour (0-23)")  # disabled
dom_8 = ConstructDomain(DomainStart=panel_26, DomainEnd=panel_28)  # disabled

# ----
scroll_integer_6 = UIScrollInteger(Integer=number_slider_17, Wrap=toggle_7, Increment=number_slider_16, Bounds=dom_8)  # disabled

# ---- group: End Hour Time (continued)
get_values_30 = UiValues(Element=scroll_integer_6)  # disabled
panel_76 = Panel(get_values_30)  # disabled

# ----
merge_12 = Merge(Data1=flatten(panel_75), Data2=flatten(panel_64), Data3=flatten(panel_66))

panel_77 = Panel(merge_12)
list_5 = ValueList({"Body": 0, "Bold": 1, "Title": 2, "Subtitle": 3, "Subtext": 4}, selected="Body")
label_3 = UILabel(Label=merge_12, Style=list_5)

merge_13 = Merge(Data1=flatten(scroll_integer_6), Data2=flatten(scroll_integer), Data3=flatten(scroll_integer_2))
grid_5 = UiGridLayout(Elements=merge_13, Columns=panel_33, Rows=panel_34)
grid_6 = UiGridLayout(Elements=label_3, Columns=panel_39, Rows=panel_38)
merge_14 = Merge(
    Data2=flatten(dropdown_list_9),
    Data3=flatten(slider_2),
    Data4=flatten(slider),
    Data5=flatten(label),
    Data6=flatten(grid_4),
    Data7=flatten(grid_3),
    Data8=flatten(grid_6),
    Data9=flatten(grid_5))
