# Grasshopper definition 05c511a9.gh (Grasshopper 1.0.8)
# plug-ins: RhinoCodePluginGH, UiPlus

json_to_gh_tree = Python3Script()  # -> a, b
# ---------- json_to_gh_tree: Python ----------
import json
from Grasshopper import DataTree
from Grasshopper.Kernel.Data import GH_Path

# Replace with your JSON file path
json_file_path = r"C:\YH\01Architecture LTD\5. Tools\01A Grasshopper Plugin\ArchiTools_V3.0_UI\GH Files - master\Auto_github_file_links.json"

# Load the JSON data
with open(json_file_path, "r") as file:
    data = json.load(file)

# Determine the items from the JSON.
if isinstance(data, dict):
    if "items" in data:
        items = data["items"]
    else:
        items = [data]
elif isinstance(data, list):
    items = data
else:
    items = []

print("Loaded", len(items), "item(s) from the JSON.")

# Create two DataTrees:
# a: DataTree of strings for titles (keys only)
# b: DataTree for values only (kept as object)
tree_titles = DataTree[str]()
tree_values = DataTree[object]()

# Process each item (each branch)
for i, item in enumerate(items):
    path = GH_Path(i)
    
    if isinstance(item, dict):
        keys = list(item.keys())
        values = list(item.values())
        print("Item", i, "keys:", keys)
        print("Item", i, "values:", values)
        
        # Add keys (titles) to tree_titles and values to tree_values
        tree_titles.AddRange(keys, path)
        tree_values.AddRange(values, path)
    else:
        print("Item", i, "is not a dictionary:", item)
        tree_titles.Add("value", path)
        tree_values.Add(item, path)

# Outputs:
# a: Tree with titles (key names only)
# b: Tree with values only
a = tree_titles
b = tree_values
# ---------- end json_to_gh_tree ----------
item = ListItem(List=json_to_gh_tree.b, Index=0, Wrap=True)  # -> Item, Item1, Item2, Item3
split = TextSplit(Text=item.Item1, Separators="/")
item_2 = ListItem(List=split, Index=0, Wrap=True)  # -> Item, Item1
toggle = BooleanToggle(True)
tab = Data(item_2.Item)
name = Data(item_2.Item1)
link = Data(item.Item2)
panel = Panel(link)
bang = ExplodeTree(Data=toggle)  # -> Branch0, Branch1
item_3 = ListItem(List=flatten(bang.Branch0), Index=0, Wrap=True)
authorization_v3_0_limit_vercel = Python3Script(toggle=item_3)  # -> out, a
# ---------- authorization_v3_0_limit_vercel: Python ----------
import requests
import Rhino
from requests.exceptions import RequestException

# Node.js server URL
AUTH_URL = "https://architool-v3-server.vercel.app/authorize"

# Create a session for connection reuse
session = requests.Session()

def check_authorization(serial_number: str) -> (bool, str, int):
    """
    Checks authorization by querying the Node.js server with the given serial number.

    Parameters:
        serial_number (str): The Rhino serial number.
        
    Returns:
        tuple: (authorized (bool), message (str), remaining_uses (int))
    """
    try:
        response = session.get(AUTH_URL, params={'serialNumber': serial_number}, timeout=5)
        response.raise_for_status()  # Ensure we raise for bad HTTP responses
        
        data = response.json()
        authorized = data.get('authorized', False)
        message = data.get('message', "No message").strip()
        remaining_uses = data.get('remainingUses', 0)
        
        return authorized, message, remaining_uses
    except RequestException as req_err:
        print(f"Request error during authorization check: {req_err}")
    except ValueError as json_err:
        print(f"JSON parsing error: {json_err}")
    except Exception as e:
        print(f"Unexpected error during authorization check: {e}")
    
    return False, "Error: Could not connect to the server", 0

def process_authorization(toggle: bool) -> None:
    """
    Processes the authorization check based on the toggle value.

    Parameters:
        toggle (bool): If True, perform the authorization check; if False, skip it.
    """
    if not toggle:
        print("Toggle is set to False. Skipping authorization check.")
        print("0")
        return

    serial_number = Rhino.RhinoApp.SerialNumber
    is_authorized, message, remaining_uses = check_authorization(serial_number)

    if is_authorized:
        print("Active Educational License")
        print(f"Remaining Daily Uses: {remaining_uses}")
        print("1")
    elif "daily usage limit reached" in message.lower():
        print("Error: Daily limit for your educational license has been reached.")
        print("Please contact support at info@01Architecture.com for assistance.")
        print("3")
    else:
        print("Error: Unauthorized access.")
        print("Please check your license or contact support at info@01Architecture.com.")
        print("0")

if __name__ == "__main__":
    toggle = True  # Replace or set this value as needed
    process_authorization(toggle)
    print("01A_ArchiTools V3.0")
# ---------- end authorization_v3_0_limit_vercel ----------
panel_2 = Panel(authorization_v3_0_limit_vercel.out)
item_4 = ListItem(List=authorization_v3_0_limit_vercel.out, Index=0, Wrap=True)  # -> Item2, Item1, Item
autorized = Data(item_4.Item2)
# Error: No Active Educational License Detected
# 
# It appears that no active Educational License is available for 01A_ArchiTools. Please contact support at info@01Architecture.com for assistance.
# 
# Yaniv Hatiel
item_5 = ListItem(List=panel_2, Index=0, Wrap=True)  # -> Item1, Item, Item1_2
panel_3 = Panel("""Error: Unauthorized Access
The plugin cannot be activated with your current credentials. 
This feature is reserved exclusively for users with authorized access. 
If you would like to be added to the list of exclusive users, please Contact Us.
https://archidemydoc.vercel.app/contact""")
python = GhPythonScript()  # -> out, a
# ---------- python: Python ----------
import sys

def check_ladybug_installed():
    try:
        # Attempt to import a Ladybug module
        import ladybug
        return "Ladybug is installed."
    except ImportError:
        return "Ladybug is not installed."

# Check for Ladybug installation
output = check_ladybug_installed()
print(output)
# ---------- end python ----------
panel_4 = Panel(item_5.Item1_2)
panel_5 = Panel(python.out)
button = UiButton(Label="Visit Archidemy")
button_2 = UiButton(Label="Contact Us")
# Buttons for Scripts
filter = StreamFilter(Gate=autorized, Stream0=panel_3, Stream1=item_5.Item)
panel_6 = Panel("https://drive.google.com/uc?export=download&id=113buBmasWc5Z_t1SCX8mZzsfimKm95cO")
get_values = UiValues(Element=button_2)
get_values_2 = UiValues(Element=button)
relay = Relay()
archidemy = LBEPWmap(x=get_values_2)  # -> out, a
# ---------- archidemy: Python ----------
import webbrowser as wb
import os

# URL to EPWmap.
url = 'https://archidemydoc.vercel.app/'

def mac_open(url):
    os.system("open \"\" " + url)

if x:  # _x is connected to a Boolean Toggle
    # Try to open the URL in a default browser.
    try:
        wb.open(url, 2, True)
        print('Opening EPWmap.')
    except Exception:
        mac_open(url)
else:
    print('Toggle is off. Set _epw_map to True to open EPWmap.')
# ---------- end archidemy ----------
archidemy_contact = LBEPWmap(x=get_values)  # -> out, a
# ---------- archidemy_contact: Python ----------
import webbrowser as wb
import os

# URL to EPWmap.
url = 'https://archidemydoc.vercel.app/contact'

def mac_open(url):
    os.system("open \"\" " + url)

if x:  # _x is connected to a Boolean Toggle
    # Try to open the URL in a default browser.
    try:
        wb.open(url, 2, True)
        print('Opening EPWmap.')
    except Exception:
        mac_open(url)
else:
    print('Toggle is off. Set _epw_map to True to open EPWmap.')
# ---------- end archidemy_contact ----------
concat = Concatenate(
    FragmentC=item_5.Item,
    FragmentD="==============",
    FragmentA=panel_5,
    FragmentG=relay,
    FragmentH="==============",
    FragmentB=item_5.Item1,
    FragmentI=item_5.Item1_2)
panel_7 = Panel(concat)
rh_cmd_btn = UiRhinoCommandButton(Label="01A_ShadowAnalysis", Commands="01A_ShadowAnalysis")
button_3 = UiButton(Label="Shadow Analysis3")
merge = Merge(Data1=flatten(button), Data2=flatten(button_2))
panel_8 = Panel("""0
1""")
panel_9 = Panel("""0
0""")
get_values_3 = UIValues(Element=rh_cmd_btn)
log = Result(concat)
py3 = Python3Script(url=panel_6)  # -> out, a; disabled
# ---------- py3: Python ----------
import clr
import os
import tempfile
import time
import Rhino
import System.Drawing  # For PointF
import ctypes
import ctypes.wintypes

# Ensure that the input 'url' is provided.
if url is None or url.strip() == "":
    result = "Update and load ArchiTool failed: No URL provided."
else:
    # --------------------------
    # Download GH file.
    # --------------------------
    def download_gh_file():
        from System.Net import WebClient
        wc = WebClient()
        temp_file = os.path.join(tempfile.gettempdir(), "model_set.gh")
        try:
            wc.DownloadFile(url, temp_file)
            if not os.path.exists(temp_file):
                return None
        except Exception:
            return None
        return temp_file

    # --------------------------
    # Window enumeration/manipulation.
    # --------------------------
    def enum_windows_callback(hwnd, lParam):
        if ctypes.windll.user32.IsWindowVisible(hwnd):
            length = ctypes.windll.user32.GetWindowTextLengthW(hwnd)
            buffer = ctypes.create_unicode_buffer(length + 1)
            ctypes.windll.user32.GetWindowTextW(hwnd, buffer, length + 1)
            if "Grasshopper" in buffer.value:
                windows_list = ctypes.cast(lParam, ctypes.POINTER(ctypes.py_object)).contents.value
                windows_list.append(hwnd)
        return True

    def find_grasshopper_window():
        windows = []
        pointer = ctypes.pointer(ctypes.py_object(windows))
        EnumWindowsProc = ctypes.WINFUNCTYPE(ctypes.c_bool, ctypes.wintypes.HWND, ctypes.wintypes.LPARAM)
        # Fix: Cast pointer to c_void_p instead of wintypes.LPARAM.
        ctypes.windll.user32.EnumWindows(EnumWindowsProc(enum_windows_callback), ctypes.cast(pointer, ctypes.c_void_p))
        return windows[0] if windows else None

    def open_grasshopper_invisibly():
        Rhino.RhinoApp.RunScript("Grasshopper", False)
        start = time.time()
        hwnd = None
        while time.time() - start < 5:
            hwnd = find_grasshopper_window()
            if hwnd:
                ctypes.windll.user32.ShowWindow(hwnd, 0)  # SW_HIDE
                break
            time.sleep(0.05)
        return hwnd

    def minimize_grasshopper_window():
        SW_MINIMIZE = 6
        hwnd = find_grasshopper_window()
        if hwnd:
            ctypes.windll.user32.ShowWindow(hwnd, SW_MINIMIZE)

    def hide_grasshopper_window_completely():
        GWL_STYLE = -16
        WS_VISIBLE = 0x10000000
        hwnd = find_grasshopper_window()
        if hwnd:
            current_style = ctypes.windll.user32.GetWindowLongW(hwnd, GWL_STYLE)
            new_style = current_style & ~WS_VISIBLE
            ctypes.windll.user32.SetWindowLongW(hwnd, GWL_STYLE, new_style)
            SWP_NOMOVE = 0x0002
            SWP_NOSIZE  = 0x0001
            SWP_FRAMECHANGED = 0x0020
            ctypes.windll.user32.SetWindowPos(hwnd, 0, 0, 0, 0, 0,
                SWP_NOMOVE | SWP_NOSIZE | SWP_FRAMECHANGED)

    # --------------------------
    # Load and run GH definition.
    # --------------------------
    def load_and_run_definition(file_path):
        try:
            from Grasshopper.Kernel import GH_DocumentIO
            gh_io = GH_DocumentIO()
            if not gh_io.Open(file_path) or gh_io.Document is None:
                return None
            gh_doc = gh_io.Document
            gh_doc.NewSolution(False)
            return gh_doc
        except Exception:
            return None

    def display_document(gh_doc):
        try:
            doc_editor = Grasshopper.Instances.DocumentEditor
            if hasattr(doc_editor, "OpenDocument"):
                doc_editor.OpenDocument(gh_doc)
            else:
                Grasshopper.Instances.ActiveCanvas.Document = gh_doc
        except Exception:
            pass

    def hide_sensitive_content(gh_doc):
        visible_names = ["UI_Plus", "Dummy"]
        off_canvas = System.Drawing.PointF(-10000, -10000)
        for obj in gh_doc.Objects:
            try:
                if hasattr(obj, "NickName") and obj.NickName not in visible_names:
                    if hasattr(obj, "Attributes") and obj.Attributes is not None:
                        obj.Attributes.Pivot = off_canvas
                        if hasattr(obj.Attributes, "RecomputeBounds"):
                            obj.Attributes.RecomputeBounds()
                        if hasattr(obj.Attributes, "ExpireLayout"):
                            obj.Attributes.ExpireLayout()
            except Exception:
                pass
        gh_doc.NewSolution(False)

    # --------------------------
    # Optimized Idle Event Handler.
    # --------------------------
    last_visible_time = None

    def on_idle(sender, e):
        global last_visible_time
        hwnd = find_grasshopper_window()
        if hwnd:
            WS_VISIBLE = 0x10000000
            style = ctypes.windll.user32.GetWindowLongW(hwnd, -16)
            if style & WS_VISIBLE:
                if last_visible_time is None:
                    last_visible_time = time.time()
                elif time.time() - last_visible_time > 0.1:
                    minimize_grasshopper_window()
                    time.sleep(0.05)
                    hide_grasshopper_window_completely()
                    last_visible_time = None
            else:
                last_visible_time = None

    Rhino.RhinoApp.Idle += on_idle

    # --------------------------
    # Main Execution.
    # --------------------------
    file_path = download_gh_file()
    if not file_path:
        result = "Update and load ArchiTool failed: GH file download error."
    else:
        open_grasshopper_invisibly()
        gh_doc = load_and_run_definition(file_path)
        if gh_doc is None:
            result = "Update and load ArchiTool failed: GH file load error."
        else:
            display_document(gh_doc)
            hide_sensitive_content(gh_doc)
            minimize_grasshopper_window()
            hide_grasshopper_window_completely()
            result = "Update and load ArchiTool successful."
# ---------- end py3 ----------

list = ValueList({"Left": 0, "Center": 1, "Right": 2, "Stretch": 3}, selected="Stretch")
resize = UiResize(Element=merge, Alignment=list)

grid = UiGridLayout(Elements=merge, Columns=panel_8, Rows=panel_9)
tab_2 = UITabbedLayout(Elements=rh_cmd_btn, Names="Site Analysis")
panel_11 = Panel(filter)
panel_12 = Panel("""Empowering the architectural community 
through innovative design tools, education, and practical applications""")

# ----
# Basic
panel_13 = Panel("ArchiTool V3.0")

filter_2 = StreamFilter(Gate=autorized, Stream1=tab_2)
filter_3 = StreamFilter(Gate=autorized, Stream1=rh_cmd_btn)
text_block = UITextBlock(Text=panel_11)

# ----
# Title
text_block_2 = UITextBlock(Text=panel_12)
text_block_3 = UITextBlock(Text=panel_13)
font = UiSetFont(Element=text_block_3, Family="Rajdhani", Size=20, Bold=True)

font_2 = UiSetFont(Element=text_block, Family="Rajdhani", Size=12, Bold=True)
merge_2 = Merge(Data1=flatten(text_block_3), Data2=flatten(text_block_2), Data3=flatten(text_block), Data4=flatten(grid))
merge_3 = Merge(Data1=flatten(text_block_2), Data2=flatten(text_block))
font_3 = UiSetFont(Element=merge_3, Family="Rajdhani")
spacer = UiSpacer(Width=10, Horizontal=False)
merge_4 = Merge(Data1=flatten(text_block_3), Data2=flatten(merge_3), Data3=flatten(spacer), Data4=flatten(grid))
merge_5 = Merge(Data1=flatten(merge_2), Data2=flatten(filter_2), Data3=flatten(filter_3))
card = UiCardLayout(Elements=merge_4, Title="ArchiTool V3.0")
merge_6 = Merge(Data1=flatten(card), Data2=flatten(merge_5))
even_margin_padding = UiEvenMarginPadding(Element=card, Margin=Toggle(False), Distance=Slider(0, range=0..1000))
window = UIWindow(Elements=merge_6, Title="ArchiTool V3.0", Owner=2, Scroll=Button(), Launch=toggle)
pt = ConstructPoint(XCoordinate=Slider(75, range=0..200), YCoordinate=Slider(51, range=0..500), ZCoordinate=0)
modify_win = UiModifyWindow(Window=window, Position=pt, HideControls=True, HideTitle=True)
