# Grasshopper definition 2fb7f924.gh (Grasshopper 1.0.8)
# plug-ins: UiPlus

command = Data(simplify(Tree({0}: ["01A_TerrainGenerator"], {1}: ["01A_R2R_GenericModel"], {2}: ["01A_AnnualDaylight"], {4}: ["01A_OutdoorWindAnalysis"], {5}: ["01A_ShadowAnalysis"], {6}: ["01A_RadiationAnalysis"], {7}: ["01A_WindRose"], {8}: ["01A_ShadingFactor"], {9}: ["01A_SD_Modeling"])))
python = GhPythonScript()  # -> out, a
# ---------- python: Python ----------
import sys

def check_ladybug_installed():
    try:
        # Attempt to import a Ladybug module
        import ladybug
        return "Ladybug is installed."
    except ImportError:
        return "Ladybug is not installed."

# Check for Ladybug installation
output = check_ladybug_installed()
print(output)
# ---------- end python ----------
panel = Panel("Site Analysis")
list = ValueList({"Left": 0, "Center": 1, "Right": 2, "Stretch": 3}, selected="Stretch")
button = UiButton(Label="Visit Archidemy")
list_2 = ValueList({"Left": 0, "Center": 1, "Right": 2, "Stretch": 3}, selected="Stretch")
panel_2 = Panel("""0
1""")
# Buttons for Scripts
panel_3 = Panel(python.out)
toggle = BooleanToggle(True)
bang = ExplodeTree(Data=toggle)  # -> Branch0, Branch1
item = ListItem(List=flatten(bang.Branch0), Index=0, Wrap=True)
authorization_v3_0_2_limit_vercel = Python3Script(toggle=item)  # -> out, a; disabled
# ---------- authorization_v3_0_2_limit_vercel: Python ----------
import clr
import Rhino
import json

clr.AddReference("System")
from System.Net import WebClient, WebException

# Node.js server URL
AUTH_URL = "https://architool-v3-server.vercel.app/authorize"

def check_authorization(serial_number):
    """
    Checks authorization by querying the Node.js server with the given serial number.
    
    Parameters:
        serial_number (str): The Rhino serial number.

    Returns:
        tuple: (authorized (bool), message (str), remaining_uses (int))
    """
    try:
        # Build the full URL with query parameter
        url = "{}?serialNumber={}".format(AUTH_URL, serial_number)

        wc = WebClient()
        response_data = wc.DownloadString(url)
        
        # Parse the JSON response
        data = json.loads(response_data)
        authorized = data.get('authorized', False)
        message = data.get('message', "No message").strip()
        remaining_uses = data.get('remainingUses', 0)
        
        return authorized, message, remaining_uses
    
    except WebException as web_ex:
        # This usually indicates network issues or a bad response
        print("WebException during authorization check:", web_ex)
    except ValueError as json_err:
        # JSON parsing error
        print("JSON parsing error:", json_err)
    except Exception as e:
        # Catch-all for any other errors
        print("Unexpected error during authorization check:", e)
    
    # If we get here, something went wrong
    return False, "Error: Could not connect to the server", 0

def process_authorization(toggle):
    """
    Processes the authorization check based on the toggle value.

    Parameters:
        toggle (bool): If True, perform the authorization check; if False, skip it.
    """
    if not toggle:
        print("Toggle is set to False. Skipping authorization check.")
        print("0")
        return

    # Get the Rhino serial number
    serial_number = Rhino.RhinoApp.SerialNumber
    is_authorized, message, remaining_uses = check_authorization(serial_number)

    # Handle the response
    if is_authorized:
        print("Active Educational License")
        print("Remaining Daily Uses: {}".format(remaining_uses))
        print("1")
    elif "daily usage limit reached" in message.lower():
        print("Error: Daily limit for your educational license has been reached.")
        print("Please contact support at info@01Architecture.com for assistance.")
        print("3")
    else:
        print("Error: Unauthorized access.")
        print("Please check your license or contact support at info@01Architecture.com.")
        print("0")

if __name__ == "__main__":
    toggle = True  # Change this based on your Grasshopper input
    process_authorization(toggle)
    print("01A_ArchiTools V3.0")
# ---------- end authorization_v3_0_2_limit_vercel ----------
# Title
authorization_v3_0_3_limit_vercel = Python3Script(toggle=item)  # -> out, a
# ---------- authorization_v3_0_3_limit_vercel: Python ----------
import clr 
import Rhino
import json

clr.AddReference("System")
from System.Net import WebClient, WebException, WebExceptionStatus, HttpWebResponse

# Node.js server URL
AUTH_URL = "https://architool-v3-server.vercel.app/authorize"

def check_authorization(serial_number):
    """
    Checks authorization by querying the Node.js server with the given serial number.
    
    Parameters:
        serial_number (str): The Rhino serial number.

    Returns:
        tuple: (authorized (bool), message (str), return_value (int))
               When authorized, return_value is the remaining daily uses.
               When an error occurs, return_value is an error code:
                   20 = Internet connection error
                   30 = Server connection error
                   40 = JSON parsing error
                   50 = Unexpected error
                   60 = Unauthorized access error
    """
    try:
        # Build the full URL with query parameter
        url = "{}?serialNumber={}".format(AUTH_URL, serial_number)
        wc = WebClient()
        response_data = wc.DownloadString(url)
        
        # Parse the JSON response
        data = json.loads(response_data)
        authorized = data.get('authorized', False)
        message = data.get('message', "No message").strip()
        remaining_uses = data.get('remainingUses', 0)
        
        return authorized, message, remaining_uses
    
    except WebException as web_ex:
        # If the exception has a response, we try to inspect it for status code details
        if web_ex.Response is not None:
            http_response = web_ex.Response
            # Ensure we have an HttpWebResponse to extract status code information
            if isinstance(http_response, HttpWebResponse):
                status_code = int(http_response.StatusCode)
                if status_code in (401, 403):
                    return False, "Error: Unauthorized access.", 60
        # Differentiate between internet connection issues and server issues
        if web_ex.Status in (WebExceptionStatus.ConnectFailure, 
                             WebExceptionStatus.NameResolutionFailure, 
                             WebExceptionStatus.ProxyNameResolutionFailure):
            return False, "Error: Internet connection problem. Please check your network connection.", 20
        else:
            return False, "Error: Problem connecting to the server.", 30

    except ValueError as json_err:
        return False, "Error: JSON parsing error: " + str(json_err), 40
    except Exception as e:
        return False, "Error: Unexpected error: " + str(e), 50

def process_authorization(toggle):
    """
    Processes the authorization check based on the toggle value.

    Parameters:
        toggle (bool): If True, perform the authorization check; if False, skip it.
    """
    if not toggle:
        print("Toggle is set to False. Skipping authorization check.")
        print("0")
        return

    # Get the Rhino serial number; check if valid
    serial_number = Rhino.RhinoApp.SerialNumber
    if not serial_number:
        print("Error: Could not retrieve the Rhino serial number. Please ensure Rhino is properly licensed.")
        print("10")
        return

    authorized, message, code = check_authorization(serial_number)

    # Handle the response based on the return code
    if authorized:
        print("Active Educational License")
        print("Remaining Daily Uses: {}".format(code))
        print("1")
    elif "daily usage limit reached" in message.lower():
        print("Error: Daily limit for your educational license has been reached.")
        print("Please contact support at info@01Architecture.com for assistance.")
        print("3")
    else:
        # For error cases, print the error message and its corresponding error code
        print(message)
        print(code)

if __name__ == "__main__":
    toggle = True  # Change this based on your Grasshopper input
    process_authorization(toggle)
    print("01A_ArchiTools V3.0.3")
# ---------- end authorization_v3_0_3_limit_vercel ----------
item_2 = ListItem(List=authorization_v3_0_3_limit_vercel.out, Index=0, Wrap=True)  # -> Item2, Item1, Item
autorized = Data(item_2.Item2)
panel_4 = Panel(authorization_v3_0_2_limit_vercel.out)
item_3 = ListItem(List=panel_4, Index=0, Wrap=True)  # -> Item1, Item, Item1_2
panel_5 = Panel("""0
0""")
panel_6 = Panel("https://drive.google.com/uc?export=download&id=113buBmasWc5Z_t1SCX8mZzsfimKm95cO")
py3 = Python3Script(url=panel_6)  # -> out, a; disabled
# ---------- py3: Python ----------
import clr
import os
import tempfile
import time
import Rhino
import System.Drawing  # For PointF
import ctypes
import ctypes.wintypes

# Ensure that the input 'url' is provided.
if url is None or url.strip() == "":
    result = "Update and load ArchiTool failed: No URL provided."
else:
    # --------------------------
    # Download GH file.
    # --------------------------
    def download_gh_file():
        from System.Net import WebClient
        wc = WebClient()
        temp_file = os.path.join(tempfile.gettempdir(), "model_set.gh")
        try:
            wc.DownloadFile(url, temp_file)
            if not os.path.exists(temp_file):
                return None
        except Exception:
            return None
        return temp_file

    # --------------------------
    # Window enumeration/manipulation.
    # --------------------------
    def enum_windows_callback(hwnd, lParam):
        if ctypes.windll.user32.IsWindowVisible(hwnd):
            length = ctypes.windll.user32.GetWindowTextLengthW(hwnd)
            buffer = ctypes.create_unicode_buffer(length + 1)
            ctypes.windll.user32.GetWindowTextW(hwnd, buffer, length + 1)
            if "Grasshopper" in buffer.value:
                windows_list = ctypes.cast(lParam, ctypes.POINTER(ctypes.py_object)).contents.value
                windows_list.append(hwnd)
        return True

    def find_grasshopper_window():
        windows = []
        pointer = ctypes.pointer(ctypes.py_object(windows))
        EnumWindowsProc = ctypes.WINFUNCTYPE(ctypes.c_bool, ctypes.wintypes.HWND, ctypes.wintypes.LPARAM)
        # Fix: Cast pointer to c_void_p instead of wintypes.LPARAM.
        ctypes.windll.user32.EnumWindows(EnumWindowsProc(enum_windows_callback), ctypes.cast(pointer, ctypes.c_void_p))
        return windows[0] if windows else None

    def open_grasshopper_invisibly():
        Rhino.RhinoApp.RunScript("Grasshopper", False)
        start = time.time()
        hwnd = None
        while time.time() - start < 5:
            hwnd = find_grasshopper_window()
            if hwnd:
                ctypes.windll.user32.ShowWindow(hwnd, 0)  # SW_HIDE
                break
            time.sleep(0.05)
        return hwnd

    def minimize_grasshopper_window():
        SW_MINIMIZE = 6
        hwnd = find_grasshopper_window()
        if hwnd:
            ctypes.windll.user32.ShowWindow(hwnd, SW_MINIMIZE)

    def hide_grasshopper_window_completely():
        GWL_STYLE = -16
        WS_VISIBLE = 0x10000000
        hwnd = find_grasshopper_window()
        if hwnd:
            current_style = ctypes.windll.user32.GetWindowLongW(hwnd, GWL_STYLE)
            new_style = current_style & ~WS_VISIBLE
            ctypes.windll.user32.SetWindowLongW(hwnd, GWL_STYLE, new_style)
            SWP_NOMOVE = 0x0002
            SWP_NOSIZE  = 0x0001
            SWP_FRAMECHANGED = 0x0020
            ctypes.windll.user32.SetWindowPos(hwnd, 0, 0, 0, 0, 0,
                SWP_NOMOVE | SWP_NOSIZE | SWP_FRAMECHANGED)

    # --------------------------
    # Load and run GH definition.
    # --------------------------
    def load_and_run_definition(file_path):
        try:
            from Grasshopper.Kernel import GH_DocumentIO
            gh_io = GH_DocumentIO()
            if not gh_io.Open(file_path) or gh_io.Document is None:
                return None
            gh_doc = gh_io.Document
            gh_doc.NewSolution(False)
            return gh_doc
        except Exception:
            return None

    def display_document(gh_doc):
        try:
            doc_editor = Grasshopper.Instances.DocumentEditor
            if hasattr(doc_editor, "OpenDocument"):
                doc_editor.OpenDocument(gh_doc)
            else:
                Grasshopper.Instances.ActiveCanvas.Document = gh_doc
        except Exception:
            pass

    def hide_sensitive_content(gh_doc):
        visible_names = ["UI_Plus", "Dummy"]
        off_canvas = System.Drawing.PointF(-10000, -10000)
        for obj in gh_doc.Objects:
            try:
                if hasattr(obj, "NickName") and obj.NickName not in visible_names:
                    if hasattr(obj, "Attributes") and obj.Attributes is not None:
                        obj.Attributes.Pivot = off_canvas
                        if hasattr(obj.Attributes, "RecomputeBounds"):
                            obj.Attributes.RecomputeBounds()
                        if hasattr(obj.Attributes, "ExpireLayout"):
                            obj.Attributes.ExpireLayout()
            except Exception:
                pass
        gh_doc.NewSolution(False)

    # --------------------------
    # Optimized Idle Event Handler.
    # --------------------------
    last_visible_time = None

    def on_idle(sender, e):
        global last_visible_time
        hwnd = find_grasshopper_window()
        if hwnd:
            WS_VISIBLE = 0x10000000
            style = ctypes.windll.user32.GetWindowLongW(hwnd, -16)
            if style & WS_VISIBLE:
                if last_visible_time is None:
                    last_visible_time = time.time()
                elif time.time() - last_visible_time > 0.1:
                    minimize_grasshopper_window()
                    time.sleep(0.05)
                    hide_grasshopper_window_completely()
                    last_visible_time = None
            else:
                last_visible_time = None

    Rhino.RhinoApp.Idle += on_idle

    # --------------------------
    # Main Execution.
    # --------------------------
    file_path = download_gh_file()
    if not file_path:
        result = "Update and load ArchiTool failed: GH file download error."
    else:
        open_grasshopper_invisibly()
        gh_doc = load_and_run_definition(file_path)
        if gh_doc is None:
            result = "Update and load ArchiTool failed: GH file load error."
        else:
            display_document(gh_doc)
            hide_sensitive_content(gh_doc)
            minimize_grasshopper_window()
            hide_grasshopper_window_completely()
            result = "Update and load ArchiTool successful."
# ---------- end py3 ----------
panel_7 = Panel(authorization_v3_0_3_limit_vercel.out)
authorization_v3_0_limit_vercel = Python3Script(toggle=item)  # -> out, a; disabled
# ---------- authorization_v3_0_limit_vercel: Python ----------
import requests
import Rhino
from requests.exceptions import RequestException

# Node.js server URL
AUTH_URL = "https://architool-v3-server.vercel.app/authorize"

# Create a session for connection reuse
session = requests.Session()

def check_authorization(serial_number: str) -> (bool, str, int):
    """
    Checks authorization by querying the Node.js server with the given serial number.

    Parameters:
        serial_number (str): The Rhino serial number.
        
    Returns:
        tuple: (authorized (bool), message (str), remaining_uses (int))
    """
    try:
        response = session.get(AUTH_URL, params={'serialNumber': serial_number}, timeout=5)
        response.raise_for_status()  # Ensure we raise for bad HTTP responses
        
        data = response.json()
        authorized = data.get('authorized', False)
        message = data.get('message', "No message").strip()
        remaining_uses = data.get('remainingUses', 0)
        
        return authorized, message, remaining_uses
    except RequestException as req_err:
        print(f"Request error during authorization check: {req_err}")
    except ValueError as json_err:
        print(f"JSON parsing error: {json_err}")
    except Exception as e:
        print(f"Unexpected error during authorization check: {e}")
    
    return False, "Error: Could not connect to the server", 0

def process_authorization(toggle: bool) -> None:
    """
    Processes the authorization check based on the toggle value.

    Parameters:
        toggle (bool): If True, perform the authorization check; if False, skip it.
    """
    if not toggle:
        print("Toggle is set to False. Skipping authorization check.")
        print("0")
        return

    serial_number = Rhino.RhinoApp.SerialNumber
    is_authorized, message, remaining_uses = check_authorization(serial_number)

    if is_authorized:
        print("Active Educational License")
        print(f"Remaining Daily Uses: {remaining_uses}")
        print("1")
    elif "daily usage limit reached" in message.lower():
        print("Error: Daily limit for your educational license has been reached.")
        print("Please contact support at info@01Architecture.com for assistance.")
        print("3")
    else:
        print("Error: Unauthorized access.")
        print("Please check your license or contact support at info@01Architecture.com.")
        print("0")

if __name__ == "__main__":
    toggle = True  # Replace or set this value as needed
    process_authorization(toggle)
    print("01A_ArchiTools V3.0")
# ---------- end authorization_v3_0_limit_vercel ----------
tab = Data(simplify(Tree({0}: ["SiteModeling"], {1}: ["Rhino2Revit"], {2}: ["Design Performance"], {4}: ["SitaAnalysis"], {5}: ["SitaAnalysis"], {6}: ["SitaAnalysis"], {7}: ["SitaAnalysis"], {8}: ["SitaAnalysis"], {9}: ["SD_Modeling"])))
link = Data(simplify(Tree({0}: ["https://raw.githubusercontent.com/yaha-coder/q321a21/main/0d7cde21/5fb423a3.gh"], {1}: ["https://raw.githubusercontent.com/yaha-coder/q321a21/main/303a8117/f16a20e6.gh"], {2}: ["https://raw.githubusercontent.com/yaha-coder/q321a21/main/7ac68238/6ae7022f.gh"], {4}: ["https://raw.githubusercontent.com/yaha-coder/q321a21/main/db0e92ee/164416e0.gh"], {5}: ["https://raw.githubusercontent.com/yaha-coder/q321a21/main/db0e92ee/32c1ba0d.gh"], {6}: ["https://raw.githubusercontent.com/yaha-coder/q321a21/main/db0e92ee/83c87c4d.gh"], {7}: ["https://raw.githubusercontent.com/yaha-coder/q321a21/main/db0e92ee/99a96511.gh"], {8}: ["https://raw.githubusercontent.com/yaha-coder/q321a21/main/db0e92ee/9f4a9286.gh"], {9}: ["https://raw.githubusercontent.com/yaha-coder/q321a21/main/f2aeb200/2a5f6411.gh"])))
name = Data(simplify(Tree({0}: ["TerrainGenerator"], {1}: ["R2R_GenericModel"], {2}: ["AnnualDaylight"], {4}: ["OutdoorWindAnalysis"], {5}: ["ShadowAnalysis"], {6}: ["RadiationAnalysis"], {7}: ["WindRose"], {8}: ["ShadingFactor"], {9}: ["SD_Modeling"])))
text_block = UITextBlock(Text="ArchiTool V3.0")
equals = Equality(FirstNumber=autorized, SecondNumber=1)  # -> Equality, Inequality
filter = StreamFilter(Gate=equals.Equality, Stream0=item_2.Item2)
concat = Concatenate(FragmentA=item_2.Item, FragmentC=" ", FragmentB=filter)
rh_cmd_btn = UiRhinoCommandButton(Label=name, Commands=command)
tab_2 = UITabbedLayout(Elements=flatten(rh_cmd_btn), Names=flatten(tab))
filter_2 = StreamFilter(Gate=autorized, Stream1=tab_2)
filter_3 = StreamFilter(Gate=autorized, Stream1=rh_cmd_btn)  # disabled
panel_8 = Panel(rh_cmd_btn)
get_values = UiValues(Element=button)
archidemy = LBEPWmap(x=get_values)  # -> out, a
# ---------- archidemy: Python ----------
import webbrowser as wb
import os

# URL to EPWmap.
url = 'https://archidemydoc.vercel.app/'

def mac_open(url):
    os.system("open \"\" " + url)

if x:  # _x is connected to a Boolean Toggle
    # Try to open the URL in a default browser.
    try:
        wb.open(url, 2, True)
        print('Opening EPWmap.')
    except Exception:
        mac_open(url)
else:
    print('Toggle is off. Set _epw_map to True to open EPWmap.')
# ---------- end archidemy ----------
get_values_2 = UIValues(Element=rh_cmd_btn)
spacer = UiSpacer(Width=10, Horizontal=False)
resize = UiResize(Element=tab_2, Alignment=list_2)
concat_2 = Concatenate(
    FragmentC=item_3.Item,
    FragmentD="==============",
    FragmentA=panel_3,
    FragmentH="==============",
    FragmentB=item_3.Item1,
    FragmentI=item_3.Item1_2)
log = Result(concat_2)
panel_9 = Panel("""Empowering the architectural community 
through innovative design tools, education, and practical applications""")
text_block_2 = UITextBlock(Text=panel_9)
panel_10 = Panel(concat)
text_block_3 = UITextBlock(Text=panel_10)
merge = Merge(Data1=flatten(text_block_2), Data2=flatten(text_block_3))
font = UiSetFont(Element=text_block_3, Family="Rajdhani", Size=12, Bold=True)
panel_11 = Panel(item_3.Item1_2)
font_2 = UiSetFont(Element=text_block, Family="Rajdhani", Size=20, Bold=True)
panel_12 = Panel("01A_ShadowAnalysis")
# Error: No Active Educational License Detected
# 
# It appears that no active Educational License is available for 01A_ArchiTools. Please contact support at info@01Architecture.com for assistance.
# 
# Yaniv Hatiel
panel_13 = Panel(concat_2)
panel_14 = Panel(concat_2)
button_2 = UiButton(Label="Contact Us")
get_values_3 = UiValues(Element=button_2)
merge_2 = Merge(Data1=flatten(button), Data2=flatten(button_2))
archidemy_contact = LBEPWmap(x=get_values_3)  # -> out, a
# ---------- archidemy_contact: Python ----------
import webbrowser as wb
import os

# URL to EPWmap.
url = 'https://archidemydoc.vercel.app/contact'

def mac_open(url):
    os.system("open \"\" " + url)

if x:  # _x is connected to a Boolean Toggle
    # Try to open the URL in a default browser.
    try:
        wb.open(url, 2, True)
        print('Opening EPWmap.')
    except Exception:
        mac_open(url)
else:
    print('Toggle is off. Set _epw_map to True to open EPWmap.')
# ---------- end archidemy_contact ----------
resize_2 = UiResize(Element=merge_2, Alignment=list)
panel_15 = Panel("""0
1""")
grid = UiGridLayout(Elements=merge_2, Columns=panel_15, Rows=panel_5)
merge_3 = Merge(Data1=flatten(text_block), Data2=flatten(merge), Data3=flatten(spacer), Data4=flatten(grid))
merge_4 = Merge(Data1=flatten(text_block), Data2=flatten(text_block_2), Data3=flatten(text_block_3), Data4=flatten(grid))
merge_5 = Merge(Data1=flatten(merge_4), Data2=flatten(filter_2), Data3=flatten(filter_3))
card = UiCardLayout(Elements=merge_3, Title="ArchiTool V3.0")
merge_6 = Merge(Data1=flatten(card), Data2=flatten(spacer), Data3=flatten(merge_5))
font_3 = UiSetFont(Element=merge, Family="Rajdhani")
pt = ConstructPoint(XCoordinate=Slider(75, range=0..200), YCoordinate=Slider(51, range=0..500), ZCoordinate=0)
window = UIWindow(Elements=merge_6, Title="ArchiTool V3.0", Owner=2, Scroll=Button(), Launch=toggle)
modify_win = UiModifyWindow(Window=window, Position=pt, HideControls=True, HideTitle=True)
# Basic
even_margin_padding = UiEvenMarginPadding(Element=card, Margin=Toggle(False), Distance=Slider(0, range=0..1000))
button_3 = UiButton(Label="Shadow Analysis3")
graphics = UiSetGraphics(
    Element=merge_2,
    PrimaryColor=ColourSwatch(SwatchColor=RGB(130, 130, 130)),
    AccentColor=ColourSwatch(SwatchColor=RGB(255, 255, 255)))
swatch = ColourSwatch(SwatchColor=RGB(230, 230, 230))
graphics_2 = UiSetGraphics(Element=rh_cmd_btn, AccentColor=swatch, StrokeColor=swatch)
panel_16 = Panel(concat)
panel_17 = Panel("""0
0""")
grid_2 = UiGridLayout(Elements=tab_2, Columns=panel_2, Rows=panel_17)
