# Grasshopper definition 164416e0.gh (Grasshopper 1.0.8)
# plug-ins: Eddy3D, MetaHopper, UiPlus

# ----
# Run
panel = Panel("0. Reset")
button = UiButton(Label=panel)
get_values = UiValues(Element=button)
bool = Boolean(get_values)
panel_2 = Panel(get_values)
reset_button = Python3Script(x=bool)  # -> out, a
# ---------- reset_button: Python ----------
import Grasshopper as gh

# Make 'previous' persist across script executions
global previous
try:
    previous
except NameError:
    previous = False

# Default output
pulse = False

# Detect a rising edge: (x == True) AND (previous == False)
if x and not previous:
    pulse = True
    # Schedule an immediate re-calculation to reset output
    doc = ghenv.Component.OnPingDocument()
    if doc:
        doc.ScheduleSolution(1, lambda d: ghenv.Component.ExpireSolution(False))

# Store the current state for next run
previous = x

# Output the one-shot pulse
a = pulse
# ---------- end reset_button ----------
panel_3 = Panel(reset_button.a)

# ----
# Run
panel_4 = Panel("4.Display Results")
button_2 = UiButton(Label=panel_4)
get_values_2 = UiValues(Element=button_2)
bool_2 = Boolean(get_values_2)
panel_5 = Panel(get_values_2)
reset_button_2 = Python3Script(x=bool_2)  # -> out, a; same code as reset_button
panel_6 = Panel(reset_button_2.a)

# ----
# Run
panel_7 = Panel("3.Run Simulation")
button_3 = UiButton(Label=panel_7)
get_values_3 = UiValues(Element=button_3)
bool_3 = Boolean(get_values_3)
panel_8 = Panel(get_values_3)
reset_button_3 = Python3Script(x=bool_3)  # -> out, a; same code as reset_button
panel_9 = Panel(reset_button_3.a)

# ----
# Run
panel_10 = Panel("2.Run Mesh")
button_4 = UiButton(Label=panel_10)
get_values_4 = UiValues(Element=button_4)
bool_4 = Boolean(get_values_4)
panel_11 = Panel(get_values_4)
reset_button_4 = Python3Script(x=bool_4)  # -> out, a; same code as reset_button
panel_12 = Panel(reset_button_4.a)

# ----
# Run
panel_13 = Panel("1.Update Geo")
button_5 = UiButton(Label=panel_13)
get_values_5 = UiValues(Element=button_5)
panel_14 = Panel(get_values_5)
bool_5 = Boolean(get_values_5)
reset_button_5 = Python3Script(x=bool_5)  # -> out, a; same code as reset_button
panel_15 = Panel(reset_button_5.a)

# ----
# Title
# Select GEO
panel_16 = Panel("V3.0.3")
text_block = UITextBlock(Text=panel_16)  # disabled

check_box = UiCheckBox(Label="Display Wind Speed", State=False)
run_bluecfd_2020 = Python3Script()  # -> out, a
# ---------- run_bluecfd_2020: Python ----------
import subprocess
import ctypes
import ctypes.wintypes
import time

# Step 1: Launch the blueCFD terminal
subprocess.Popen(
    r'"C:\Program Files\blueCFD-Core-2020\blueCFD-Core_MSys2_mingw64.bat"',
    shell=True
)

# Step 2: Allow time for the window to open
time.sleep(1.5)

# Step 3: Find the window with title "MinGW x64" and minimize it
SW_MINIMIZE = 6

EnumWindows = ctypes.windll.user32.EnumWindows
EnumWindowsProc = ctypes.WINFUNCTYPE(
    ctypes.c_bool,
    ctypes.wintypes.HWND,
    ctypes.wintypes.LPARAM
)
IsWindowVisible = ctypes.windll.user32.IsWindowVisible
GetWindowTextLength = ctypes.windll.user32.GetWindowTextLengthW
GetWindowText = ctypes.windll.user32.GetWindowTextW
ShowWindow = ctypes.windll.user32.ShowWindow

found_hwnd = None

def foreach_window(hwnd, lParam):
    if not IsWindowVisible(hwnd):
        return True
    length = GetWindowTextLength(hwnd)
    if length == 0:
        return True
    buff = ctypes.create_unicode_buffer(length + 1)
    GetWindowText(hwnd, buff, length + 1)
    title = buff.value
    if "MinGW x64" in title:
        global found_hwnd
        found_hwnd = hwnd
        return False  # Found it — stop searching
    return True

EnumWindows(EnumWindowsProc(foreach_window), 0)

if found_hwnd:
    ShowWindow(found_hwnd, SW_MINIMIZE)
else:
    print("Window with title 'MinGW x64' not found.")
# ---------- end run_bluecfd_2020 ----------
text_block_2 = UITextBlock(Text="Outdoor Wind Analysis")

# ----
# # IMPORTANT:
# Ensure the document is set to 'Meters'
# before running the script.
# 
# If not, close Rhino, reopen it, set units to 'Meters',
# and then run the script.
units_check = GhPythonScript()
# ---------- units_check: Python ----------
import rhinoscriptsyntax as rs
import Rhino
import scriptcontext as sc
from System.Windows.Forms import MessageBox

# Get the active Rhino document
doc = Rhino.RhinoDoc.ActiveDoc

# Check if the document is not using meters as the unit
if doc.ModelUnitSystem != Rhino.UnitSystem.Meters:
    # Display a popup message with additional instructions
    MessageBox.Show(
        "Warning: Rhino document units are not set to meters.\n\n"
        "Please close Rhino completely, reopen it, change the units to Meters, "
        "and only then open the Grasshopper file.",
        "Units Check"
    )
# ---------- end units_check ----------

get_values_6 = UiValues(Element=check_box)

rh_sel_btn = UiRhinoSelectButton(Label="Analysis Surface", Filter=16)
get_values_7 = UIValues(Element=rh_sel_btn)
srf = Surface(get_values_7)

rh_sel_btn_2 = UiRhinoSelectButton(Label="Context", Filter=16)
get_values_8 = UIValues(Element=rh_sel_btn_2)
brep = Brep(get_values_8)

font = UiSetFont(Element=[text_block_2, button_4, button_2, button, button_5, button_3], Family="Rajdhani", Size=20, Bold=True)

Z = UnitZ(Factor=Slider(0.01, range=0..0.01))
panel_17 = Panel(get_values_7)
move = Move(Geometry=srf, Motion=Z)  # -> Geometry, Transform
wires = BrepWireframe(Brep=srf, Density=-1)

# ---- group: ad
dam = DataDam(DataGeo=brep, BufferDelay=10000000, BufferMode=0)
objfromgroup = GetObjectsInGroup()

# ----
brep_2 = Brep(dam)

lng = ListLength(List=objfromgroup)
dup = DuplicateData(Data=reset_button_5.a, Number=lng, Order=True)
setobj = SetObjectValue(ObjectToSet=objfromgroup, ValueToSet=dup)

spacer = UiSpacer(Width=10, Horizontal=False)
merge = Merge(
    Data1=flatten(button),
    Data2=flatten(spacer),
    Data3=flatten(button_5),
    Data4=flatten(button_4),
    Data5=flatten(button_3),
    Data6=flatten(button_2))
merge_2 = Merge(Data1=flatten(check_box))

card = UiCardLayout(Elements=merge, Title="Run")

button_6 = Merge(Data1=flatten(rh_sel_btn), Data2=flatten(rh_sel_btn_2))
card_2 = UiCardLayout(Elements=button_6, Title="Select Geometry")

card_3 = UiCardLayout(Elements=merge_2, Title="Display")

check_bluecfd = Python3Script()  # -> out, a
# ---------- check_bluecfd: Python ----------
import os
import re

# Define the parent directory where the folders are located
parent_dir = r"C:\ProgramData\Microsoft\Windows\Start Menu\Programs"

# List to store detected version numbers
versions = []

# Loop through each item in the parent directory
for item in os.listdir(parent_dir):
    full_path = os.path.join(parent_dir, item)
    # Ensure it's a directory and contains 'blueCFD-Core'
    if os.path.isdir(full_path) and "blueCFD-Core" in item:
        # Extract the version number after "blueCFD-Core"
        match = re.search(r"blueCFD-Core\s*(\d+)", item)
        if match:
            versions.append(match.group(1))

# Print the result as a single message if any versions were found
if versions:
    print("Found BlueCFD version: " + ", ".join(versions))
else:
    print("No BlueCFD-Core folders found with a version number.")
# ---------- end check_bluecfd ----------
panel_19 = Panel(check_bluecfd.out)
text_block_3 = UITextBlock(Text=check_bluecfd.out)
geo = Geometry(brep_2)
data = Data(srf)
bbox = BoundingBox(Content=data, Plane=PlaneXY(0, 0, 0))  # -> Box, Box_2
number_slider = Slider(2.5, range=0..10)
debox = DeconstructBox(Box=bbox.Box)  # -> Plane, X, Y, Z
number_slider_2 = Slider(0.1, range=0..10)
division = Division(A=number_slider, B=number_slider)
multiplication = Multiplication(A=number_slider_2, B=3)
number_slider_3 = Slider(3, range=0..10)
number_slider_4 = Slider(1, range=0..10)

# ----
# 3. Mesh & Simulation
panel_20 = Panel("3")
panel_21 = Panel("C:\Eddy3D\3_SimpleWindAnalysis")

# ----
# 6. Clean
clean = Clean(Directory=panel_21, Mode=2, Run=reset_button.a)

number_slider_5 = Slider(1.6, range=0..10)
multiplication_2 = Multiplication(A=Slider(0, range=0..100), B=-1)
multiplication_3 = Multiplication(A=Slider(14, range=0..100), B=-1)
mset = MeshSettings(AccBuilding=2, AccFeatures=panel_20, AccBBox=0, AccGround=panel_20, MiscSettings=1, NumberOfLayers=4, Mode=1)
neg = Negative(Value=multiplication_2)
neg_2 = Negative(Value=multiplication_3)
linetype = ModelLinetype(Name="01A_ArchiTool2", Width=Slider(1.5, range=0..10))  # -> Linetype, Name, Segments, CapStyle, JoinStyle, Width, WidthUnits
linetype_2 = ModelLinetype(Name="01A_ArchiTool", Segments=[multiplication_3, neg_2], Width=Slider(2.3, range=0..10))  # -> Linetype, Name, Segments, CapStyle, JoinStyle, Width, WidthUnits
linetype_3 = ModelLinetype(Name="01A_ArchiTool2", Width=Slider(0.3, range=0..10))  # -> Linetype, Name, Segments, CapStyle, JoinStyle, Width, WidthUnits
swatch = ColourSwatch(SwatchColor=RGB(54, 54, 54))
wires_2 = BrepWireframe(Brep=brep_2, Density=-1)
preview = CustomPreview(Geometry=[brep_2, srf], Material=ColourSwatch(SwatchColor=RGBA(255, 255, 255, 121)))  # disabled
preview_2 = CustomPreview(Geometry=brep_2, Material=ColourSwatch(SwatchColor=RGB(255, 255, 255)))
curve_preview = CustomCurvePreview(Curve=wires, Linetype=linetype_2.Linetype, Colour=swatch)
curve_preview_2 = CustomCurvePreview(Curve=wires_2, Linetype=linetype.Linetype, Colour=swatch)
preview_3 = CustomPreview(Geometry=brep_2, Material=ColourSwatch(SwatchColor=RGB(217, 48, 48)))

# ----
# 4. Probing points & probing
brep_3 = Brep(srf)

# ---- group: Start Hour Time
number_slider_6 = Slider(1, range=0..10)
number_slider_7 = Slider(10, range=0..23)
panel_22 = Panel("Res")
toggle = BooleanToggle(True)
dom = ConstructDomain(DomainStart="1", DomainEnd="100")

# ----
scroll_integer = UIScrollInteger(Label=panel_22, Integer=100, Wrap=toggle, Increment=number_slider_6, Bounds=dom)

# ---- group: Start Hour Time (continued)
get_values_9 = UiValues(Element=scroll_integer)
panel_23 = Panel(get_values_9)

# ----
list = ValueList({"Left": 0, "Center": 1, "Right": 2, "Stretch": 3}, selected="Stretch")
resize = UiResize(Element=[rh_sel_btn, rh_sel_btn_2, scroll_integer, button_4, button_2, button, button_5, button_3], Alignment=list)

# ---- group: Start Hour Time
number_slider_8 = Slider(1, range=0..10)
number_slider_9 = Slider(0, range=0..23)
panel_24 = Panel("Wind Direction")
toggle_2 = BooleanToggle(True)
dom_2 = ConstructDomain(DomainStart="0", DomainEnd="359")

# ----
scroll_integer_2 = UIScrollInteger(Label=panel_24, Integer=number_slider_9, Wrap=toggle_2, Increment=number_slider_8, Bounds=dom_2)

# ---- group: Start Hour Time (continued)
get_values_10 = UiValues(Element=scroll_integer_2)
panel_25 = Panel(get_values_10)

number_slider_10 = Slider(10, range=0..23)
panel_26 = Panel("Wind Speed")
dom_3 = ConstructDomain(DomainStart="0", DomainEnd="100")

# ----
scroll_number = UiScrollNumber(Label=panel_26, Number=number_slider_10, Wrap=dom_3, Digits=2, Increment=0.1)

# ---- group: Start Hour Time (continued)
get_values_11 = UiValues(Element=scroll_number)
panel_27 = Panel(get_values_11)

# ----
# 1. Geometry &
# Boundary Conditions
mesh = Mesh(geo)
abl_flow = ABLFlow(WindDirections=get_values_10, ReferenceVelocityAtZref_m_s=get_values_11)
mjoin = MeshJoin(Meshes=mesh)

bbox_2 = BoundingBox(Content=mjoin, Plane=PlaneXY(0, 0, 0), UnionBox=True)  # -> Box, Box_2
area = Area(Geometry=bbox_2.Box)  # -> Area, Centroid
xy = XYPlane(Origin=area.Centroid)
debox_2 = DeconstructBox(Box=bbox_2.Box)  # -> Plane, X, Y, Z
num = Number(debox_2.X)
num_2 = Number(debox_2.Y)
multiplication_4 = Multiplication(A=num, B=multiplication)
multiplication_5 = Multiplication(A=num_2, B=number_slider_2)

# ----
# 2. Simulation Domain
domainbox = BoxShapedDomain(Geometry=mjoin, BoundaryCondition=abl_flow, BlockSize=20)  # -> Domain, Mesh

data_2 = Data(domainbox.Mesh)
bbox_3 = BoundingBox(Content=data_2, Plane=PlaneXY(0, 0, 0))  # -> Box, Box_2
medges = MeshEdges(Mesh=data_2)  # -> NakedEdges, InteriorEdges, NonManifoldEdges
data_3 = Data(medges.InteriorEdges)
wires_3 = BrepWireframe(Brep=[bbox_3.Box, brep_3], Density=-1)
curve_preview_3 = CustomCurvePreview(Curve=wires_3, Linetype=linetype_3.Linetype, Colour=ColourSwatch(SwatchColor=RGB(66, 62, 62)))
probing = Probing(BuildingMesh=mjoin, GroundMesh=brep_3, TargetCount=Slider(5261, range=0..10000), ConvertQuadsToTriangles=True)
demesh = DeconstructMesh(Mesh=probing)  # -> Vertices, Faces, Colours, Normals

# ---- group: Start Hour Time
panel_28 = Panel("Iteration")
dom_4 = ConstructDomain(DomainStart="0", DomainEnd="200")

# ----
scroll_number_2 = UiScrollNumber(Label=panel_28, Number=50, Wrap=dom_4, Digits=2, Increment=0.1)

# ---- group: Start Hour Time (continued)
get_values_12 = UiValues(Element=scroll_number_2)
panel_29 = Panel(get_values_12)

# ----
merge_3 = Merge(
    Data1=flatten(scroll_integer),
    Data2=flatten(scroll_integer_2),
    Data3=flatten(scroll_number),
    Data4=flatten(scroll_number_2))

card_4 = UiCardLayout(Elements=merge_3, Title="Analysis Settings")

spacer_2 = UiSpacer(Width=10, Horizontal=False)
merge_4 = Merge(
    Data1=flatten(card_2),
    Data2=flatten(spacer_2),
    Data3=flatten(card_4),
    Data4=flatten(card_3),
    Data5=flatten(spacer_2),
    Data6=flatten(card))
panel_30 = Panel(merge_4)
lng_2 = ListLength(List=merge_4)
merge_5 = Merge(Data1=flatten(merge_4))
dup_2 = DuplicateData(Data="Analysis", Number=lng_2, Order=True)
tab = UiTabbedLayout(Elements=merge_5, Names=dup_2)

relay = Relay([card_4, card_3])
swatch_2 = ColourSwatch(SwatchColor=RGB(237, 237, 237))
merge_6 = Merge(Data1=flatten(card_2), Data2=flatten(card), Data3=flatten(relay))
swatch_3 = ColourSwatch(SwatchColor=RGB(237, 237, 237))
graphics = UiSetGraphics(
    Element=merge_6,
    PrimaryColor=ColourSwatch(SwatchColor=RGB(0, 0, 0)),
    AccentColor=ColourSwatch(SwatchColor=RGB(255, 255, 255)),
    StrokeColor=swatch_3,
    StrokeWeight=0)
graphics_2 = UiSetGraphics(
    Element=button_6,
    PrimaryColor=ColourSwatch(SwatchColor=RGB(115, 115, 115)),
    AccentColor=swatch_3,
    StrokeColor=swatch_3,
    StrokeWeight=0)

au = Au(d1=text_block_2, d2=text_block, d3arwxe_af_iztbmm_ji187p_qmgtruvha_3m_q1=brep_2, d5=tab, d3=text_block_3)
panel_31 = Panel(au)

pt = Point(Point(0, 0, 0))
pt_2 = ConstructPoint(XCoordinate=Slider(75, range=0..200), YCoordinate=Slider(51, range=0..500), ZCoordinate=0)
window = UIWindow(Elements=au, Title="ArchiTool V3.0.3", Owner=2, Scroll=True, Launch=Toggle(True))
modify_win = UiModifyWindow(Window=window, Position=pt_2, HideControls=True, HideTitle=True)

rset = RunSettings(
    NumberOfIterations=get_values_12,
    WriteInterval=20,
    NumberOfTimestepsToKeep=3,
    TurbulenceModel=1,
    RelaxationFactors=3,
    SolutionAndAlgorithmControl=1,
    PotentialFoamInitialization=False,
    AgeOfAir=False,
    NumberOfCPUs="-1",
    OperatingSystem=0)
simulation = Simulation(
    SimulationDomain=domainbox.Domain,
    WorkingDirectory=panel_21,
    MeshSettings=mset,
    RunSettings=rset,
    RunMeshing=reset_button_4.a,
    MakeTrees=False,
    RunSimulation=reset_button_3.a,
    runWithBlueCFD=True)
residuals = VisualizeResiduals(Result=simulation, X=":", Y=":", Version=0, Run=Button(), visResiduals=True)
panel_32 = Panel(simulation)
probing_2 = Probing(
    Result=simulation,
    ProbingPoints=demesh.Vertices,
    NameOfInstance="ttt",
    InterpolationScheme=3,
    NameOfField=0,
    Run=reset_button_2.a)  # -> ProbingPoints, ProbingResult

# ----
# 5. Post-processing
# 5.1. Paraview
# 5.2. Grasshopper
# Wind vectors
vectors = Data(probing_2.ProbingResult)
points = Data(probing_2.ProbingPoints)
cluster = Cluster(data=vectors)  # -> S, E, data_3
gradient = Gradient(
    LowerLimit=cluster.S,
    UpperLimit=Slider(5, range=0..10),
    Parameter=cluster.data_3,
    stops=[0.103: RGB(0, 0, 255), 0.22: RGB(0, 170, 255), 0.305: RGB(0, 255, 255), 0.398: RGB(0, 255, 188), 0.504: RGB(0, 255, 106), 0.605: RGB(91, 255, 0), 0.699: RGB(184, 255, 0), 0.799: RGB(255, 255, 0), 0.898: RGB(255, 170, 0)])
vdisex = VectorDisplayEx(Point=points, Vector=vectors, Colour=gradient, Width=Slider(2, range=0..10))

vlen = VectorLength(Vector=vectors)
filter = StreamFilter(Gate=get_values_6, Stream1=vlen)
tag = TextTag(Location=points, Text=filter)
paraview = Paraview(Result=simulation, ParaviewVersion=2, Run=Button())
panel_33 = Panel(cluster.S)

# ==== cluster Cluster
data = ClusterInput()
data_2 = Data(data)
data_3 = ClusterOutput(data_2)
bnd = Bounds(Numbers=data_2)
dedomain = DeconstructDomain(Domain=bnd)  # -> Start, End
S = ClusterOutput(dedomain.Start)
E = ClusterOutput(dedomain.End)

# ==== cluster Au

# ---- group: AnFv8$DA9A%+vL.LS21VwOZbTp1Fxg.tFclgZS/K*689pf(jdrmPYN4xBd9-nqak
d5 = ClusterInput()

# ---- group: $h9$0PqYnLZh.V8ZooIn1m3G%Y*xeRPtqDH9CVghTXt_H_*PakW+I+4_7X58G@Uh
d3arwxe_af_iztbmm_ji187p_qmgtruvha_3m_q1 = ClusterInput()  # "D3ARwxe*Af$IZTBmm%ji187p+!QMGtrUVhA.3M!+q1h)+y*C!hocCq4QGkSKH@5P"

# ---- group: kniNug+KOleZ2P4dF(3+f2+8I_+nSKYyN9Gg7!!kimrmn5R%rsu__Sve0HNc18L/
m9b_lkb_u6byb0etc_6n_bi_wqh_f_an_y67o_1 = ListItem(List=d3arwxe_af_iztbmm_ji187p_qmgtruvha_3m_q1, Index=0, Wrap=True)  # "M9b!lKB!u6bYB0eTc_6n*BI_wqH.F_an+y67o!1-Mb+ioKME+BH$W/1I(8Nt5-D7"

# ---- group: $h9$0PqYnLZh.V8ZooIn1m3G%Y*xeRPtqDH9CVghTXt_H_*PakW+I+4_7X58G@Uh (continued)
dxq_p_j66vq2_yb_uyqeynapsd_lewet_s_ybout = Python3Script(toggle=m9b_lkb_u6byb0etc_6n_bi_wqh_f_an_y67o_1)  # -> out, a; "dXQ(p(-j66VQ2-yB@UyQEynAPsD**+*LEWet(*s_ybOutnJOK6FgwZMnhZz*HC-!"
# ---------- dxq_p_j66vq2_yb_uyqeynapsd_lewet_s_ybout: Python ----------
import clr 
import Rhino
import json

clr.AddReference("System")
from System.Net import WebClient, WebException, WebExceptionStatus, HttpWebResponse

# Node.js server URL
AUTH_URL = "https://architool-v3-server.vercel.app/authorize"

def check_authorization(serial_number):
    """
    Checks authorization by querying the Node.js server with the given serial number.
    
    Parameters:
        serial_number (str): The Rhino serial number.

    Returns:
        tuple: (authorized (bool), message (str), return_value (int))
               When authorized, return_value is the remaining daily uses.
               When an error occurs, return_value is an error code:
                   20 = Internet connection error
                   30 = Server connection error
                   40 = JSON parsing error
                   50 = Unexpected error
                   60 = Unauthorized access error
    """
    try:
        # Build the full URL with query parameter
        url = "{}?serialNumber={}".format(AUTH_URL, serial_number)
        wc = WebClient()
        response_data = wc.DownloadString(url)
        
        # Parse the JSON response
        data = json.loads(response_data)
        authorized = data.get('authorized', False)
        message = data.get('message', "No message").strip()
        remaining_uses = data.get('remainingUses', 0)
        
        return authorized, message, remaining_uses
    
    except WebException as web_ex:
        # If the exception has a response, we try to inspect it for status code details
        if web_ex.Response is not None:
            http_response = web_ex.Response
            # Ensure we have an HttpWebResponse to extract status code information
            if isinstance(http_response, HttpWebResponse):
                status_code = int(http_response.StatusCode)
                if status_code in (401, 403):
                    return False, "Error: Unauthorized access.", 60
        # Differentiate between internet connection issues and server issues
        if web_ex.Status in (WebExceptionStatus.ConnectFailure, 
                             WebExceptionStatus.NameResolutionFailure, 
                             WebExceptionStatus.ProxyNameResolutionFailure):
            return False, "Error: Internet connection problem. Please check your network connection.", 20
        else:
            return False, "Error: Problem connecting to the server.", 30

    except ValueError as json_err:
        return False, "Error: JSON parsing error: " + str(json_err), 40
    except Exception as e:
        return False, "Error: Unexpected error: " + str(e), 50

def process_authorization(toggle):
    """
    Processes the authorization check based on the toggle value.

    Parameters:
        toggle (bool): If True, perform the authorization check; if False, skip it.
    """
    if not toggle:
        print("Toggle is set to False. Skipping authorization check.")
        print("0")
        return

    # Get the Rhino serial number; check if valid
    serial_number = Rhino.RhinoApp.SerialNumber
    if not serial_number:
        print("Error: Could not retrieve the Rhino serial number. Please ensure Rhino is properly licensed.")
        print("10")
        return

    authorized, message, code = check_authorization(serial_number)

    # Handle the response based on the return code
    if authorized:
        print("Active Educational License")
        print("Remaining Daily Uses: {}".format(code))
        print("1")
    elif "daily usage limit reached" in message.lower():
        print("Error: Daily limit for your educational license has been reached.")
        print("Please contact support at info@01Architecture.com for assistance.")
        print("3")
    else:
        # For error cases, print the error message and its corresponding error code
        print(message)
        print(code)

if __name__ == "__main__":
    toggle = True  # Change this based on your Grasshopper input
    process_authorization(toggle)
    print("01A_ArchiTools V3.0.3")
# ---------- end dxq_p_j66vq2_yb_uyqeynapsd_lewet_s_ybout ----------

# ---- group: Fi)W+5v)uqS0a66M5M$wmF*d3Ah3xjNdgrPBOKaCHvrGQGtoSORYneW$JnFZYA+p / $zBZ8vrWGLqdlIBKhvjS-esJ*LdY0)8t(I/5hkWh8pYmUAi-vZmF4X+9C5fvJ0yt
d2 = ClusterInput()
kxss_2lag_aeg_o_8aj8rz236kedgfa358j38_w1 = ListItem(List=dxq_p_j66vq2_yb_uyqeynapsd_lewet_s_ybout.out, Index=0, Wrap=True)  # -> Item2, Item1, Item; "kxss+2LaG(aeg/@o*8Aj8rZ236KEdGfa358J38(w10tNz_DjFZYswN)TwwVJYbMF"

# ---- group: 9*WGqPH*LY6m6z.lgJ(b4+*M%EB9-u-NdvSrHIovfwd1LZr*JI-4F/G71d/K)w*e
d1 = ClusterInput()

# ---- group: @2nQG2+83ndXI/h$SXgbJOh0NqWNG!m*mz+xy3zqUNASw425(jegldiqFMEIEZKM
d3 = ClusterInput()

# ---- group: 69y76U/+pU!Ynoj6mkO+k+C$XPj6)uCm(L6uH*+T5)*MdoE3qHAAPN.*I1N-9c*w / Wx+QvACM4k)jhYzC*YTU9vL!ug$m$nB+4(_By@P.JVk1xavU*@PP(qmW79ZSAP5+
jzd0qxnri_4_c3_el_dt_5lwqbbqe_lqjm3_b_fo = Panel("Rajdhani")  # "+jZD0qXNrI/4%C3)!el*DT.*5LwqBbqE.lQJM3(b-+.foOkvAz3TODiXtq$a2@iS"

# ---- group: Tne(i*1QgLK4Adg-Sxc5zY!zd%%MyS5VCG3m-YsncpX.PihnMrRIthNNxaaeK8Pe
_0gwhu_ukfgmxbycl9lh1r9bi_epj1og5_arnqje = Data(kxss_2lag_aeg_o_8aj8rz236kedgfa358j38_w1.Item2)  # "0gWhu+ukfGmxByCl9lh1R9Bi@EpJ1OG5!arnQjef46jhNOHmsS(pMXOJ6CphVjbJ"

# ---- group: sjl!MhxBI%+7*TIWzx*I2tJaW.H%gv/qPHiAQK_M)zj5q_bD(MQI_*+wi4bLX$bO / yf4CZ+A*6Rmt)IxagLmWaPIK(xCqTdXUumzl+prS0S1E2h-*)S$@vhLqJbm%O0*m
xlivj4k5zfm_xoncq5j3_fghz_lwtox48_f_eonz = Panel(dxq_p_j66vq2_yb_uyqeynapsd_lewet_s_ybout.out)  # "XlivJ4K5zfM-xOnCq5J3-fGhZ%!lwtoX48/F-EONZ$nY/D3oR*aOKmQzn!4uKX3l"

# ---- group: 69y76U/+pU!Ynoj6mkO+k+C$XPj6)uCm(L6uH*+T5)*MdoE3qHAAPN.*I1N-9c*w / Wx+QvACM4k)jhYzC*YTU9vL!ug$m$nB+4(_By@P.JVk1xavU*@PP(qmW79ZSAP5+ (continued)
e_vnn_t_w_ugxsx7ccflm__fxktfzuzxqphgshft = Equality(FirstNumber=_0gwhu_ukfgmxbycl9lh1r9bi_epj1og5_arnqje, SecondNumber=1)  # -> Equality, Inequality; "E*!vNn(T+W*ugXSx7ccFlM._FxKtFzuzxQphGsHFT)H7AwA+IrgW(e04(@MJNj)1"

# ---- group: Fi)W+5v)uqS0a66M5M$wmF*d3Ah3xjNdgrPBOKaCHvrGQGtoSORYneW$JnFZYA+p / $zBZ8vrWGLqdlIBKhvjS-esJ*LdY0)8t(I/5hkWh8pYmUAi-vZmF4X+9C5fvJ0yt (continued)
xtq4wdy42o_4w357ha9n_rv9j2_c_sab3_lz_sji = StreamFilter(Gate=e_vnn_t_w_ugxsx7ccflm__fxktfzuzxqphgshft.Equality, Stream0=kxss_2lag_aeg_o_8aj8rz236kedgfa358j38_w1.Item2)  # "xtQ4WdY42o*.4w357hA9n!+Rv9J2*@c.SAb3+lz*sjIT()2VX(+InlFr7PODma9y"

# ---- group: @2nQG2+83ndXI/h$SXgbJOh0NqWNG!m*mz+xy3zqUNASw425(jegldiqFMEIEZKM (continued)
keviyri1w_8oa6_oi_t_opdl__8_w_c_yes7wi_6 = Concatenate(
    FragmentA=kxss_2lag_aeg_o_8aj8rz236kedgfa358j38_w1.Item,
    FragmentC=" ",
    FragmentB=xtq4wdy42o_4w357ha9n_rv9j2_c_sab3_lz_sji)  # "kEvIyRI1w./8oA6/Oi.t+OPDl*_8(w%c*YES7Wi.6t@8!kpY%C_)mlFWIaE5(fV!"
r38agbg8ojqu31kszf_m4rq_vwf_fqahzc5e__b2 = Panel(keviyri1w_8oa6_oi_t_opdl__8_w_c_yes7wi_6)  # "r38AgbG8OjQU31KSzF+m4rQ/VwF%fQaHZc5E$_b2Nb!Rt5+@l*GnnFpsq*wzb_aM"

# ---- group: 69y76U/+pU!Ynoj6mkO+k+C$XPj6)uCm(L6uH*+T5)*MdoE3qHAAPN.*I1N-9c*w / Wx+QvACM4k)jhYzC*YTU9vL!ug$m$nB+4(_By@P.JVk1xavU*@PP(qmW79ZSAP5+ (continued)
ebp4ojtrx6_r20_p_ju_hivujanvxsrh6jsgs0ul = Panel(keviyri1w_8oa6_oi_t_opdl__8_w_c_yes7wi_6)  # "eBP4OjtRX6-R20+p)jU-hivujAnvXSrh6jsgs0uLK6D0._iW!uokZA@A(/5eqD6y"

# ---- group: +lsa*K2KFALhwe-Rv14fFEceMtM34ATL!X4_NM37%cqmw_gm_bKDO0eFwK9S+VB3
atuag_lz_kjegeqob3bvefkqw0bc_qkozlcb_ygr = UITextBlock(Text=ebp4ojtrx6_r20_p_ju_hivujanvxsrh6jsgs0ul)  # "ATUAG+.LZ+kjeGEqob3bvefkQW0bc*QKOzLcb(YgrYGJF6V9!rP_g%R7rBVJ0Z+v"

# ---- group: @ug(B3+Xni+F/5csHQF77x$To+vyp(kz*kZgINJmih/97Q%en)lB6qZKz1U/V%Jl
_6_dz5kuk_5xo_meblvjq_b7dj_wvxhk7pj8gfx9 = Merge(
    Data1=flatten(d1),
    Data2=flatten(d2),
    Data3=flatten(d3),
    Data4=flatten(atuag_lz_kjegeqob3bvefkqw0bc_qkozlcb_ygr),
    Data5=flatten(d5))  # "6$dZ5KUk*5Xo*.mEblVjQ.B7dj-wvXhk7pJ8GfX9w949Kp+%s8.$-V4tzhNm2lcv"
jsxfba_wmn6kw_uywq_4_p15y34o3b_vtdvsehby = Panel("Rajdhani")  # "jsXfbA/wmN6KW@uyWq.*4*p15Y34O3B(vTDVSeHByR16@T*X*dBPL@Q(+jHn@2%o"

# ---- group: Tne(i*1QgLK4Adg-Sxc5zY!zd%%MyS5VCG3m-YsncpX.PihnMrRIthNNxaaeK8Pe (continued)
R = ClusterOutput(_6_dz5kuk_5xo_meblvjq_b7dj_wvxhk7pj8gfx9)

# ---- group: sjl!MhxBI%+7*TIWzx*I2tJaW.H%gv/qPHiAQK_M)zj5q_bD(MQI_*+wi4bLX$bO / yf4CZ+A*6Rmt)IxagLmWaPIK(xCqTdXUumzl+prS0S1E2h-*)S$@vhLqJbm%O0*m (continued)
nj_19_5jvuo_cifs_nbe_ohwlil0k_1z_9_o_m_1 = UiSetFont(Element=_6_dz5kuk_5xo_meblvjq_b7dj_wvxhk7pj8gfx9, Family=jzd0qxnri_4_c3_el_dt_5lwqbbqe_lqjm3_b_fo)  # "Nj%19_5Jvuo@@cifs*nbE$ohWlil0k*1Z@9*%o_M(1xPKimVR)V)DTWq@WYI7CdK"

# ---- group: 9*WGqPH*LY6m6z.lgJ(b4+*M%EB9-u-NdvSrHIovfwd1LZr*JI-4F/G71d/K)w*e (continued)
xbygfazu_x_tyvos_qekpfbzp_2_dxrg4td_chlf = UiSetFont(Element=atuag_lz_kjegeqob3bvefkqw0bc_qkozlcb_ygr, Family=jsxfba_wmn6kw_uywq_4_p15y34o3b_vtdvsehby, Bold=True)  # "xByGFAzu_X)tyVOS@QeKPFBzP+2%Dxrg4Td_chlF*5x_4OBzD*leqtvbd(5%_Z5J"
