# Grasshopper definition 99a96511.gh (Grasshopper 1.0.8)
# plug-ins: RhinoCodePluginGH, MetaHopper, UiPlus

# ---- group: EPW DropDown List
# EPW
epw_link_list_israel = Panel("""https://climate.onebuilding.org/WMO_Region_6_Europe/ISR_Israel/Z_HaTsafon/ISR_Z_Mahanaim-Pina.AP.401761_TMYx.zip
https://climate.onebuilding.org/WMO_Region_6_Europe/ISR_Israel/Z_HaTsafon/ISR_Z_Zefat.Har.Kenaan.MS.401530_TMYx.2004-2018.zip
https://climate.onebuilding.org/WMO_Region_6_Europe/ISR_Israel/Z_HaTsafon/ISR_Z_Haifa.AP.401550_TMYx.zip
https://climate.onebuilding.org/WMO_Region_6_Europe/ISR_Israel/Z_HaTsafon/ISR_Z_Ramat.David.AB.401650_TMYx.zip
https://climate.onebuilding.org/WMO_Region_6_Europe/SYR_Syrian_Arab_Republic/SYR_QU_Sweida-UNDOF.400670_TMYx.zip
https://climate.onebuilding.org/WMO_Region_6_Europe/ISR_Israel/M_HaMerkaz/ISR_M_Netanya.401730_TMYx.zip
https://climate.onebuilding.org/WMO_Region_6_Europe/ISR_Israel/TA_Tel-Aviv/ISR_TA_Tel.Aviv-Sde.Dov.AP.401762_TMYx.zip
https://climate.onebuilding.org/WMO_Region_6_Europe/ISR_Israel/TA_Tel-Aviv/ISR_TA_Tel.Aviv-Bet.Dagan.401790_TMYx.zip
https://climate.onebuilding.org/WMO_Region_6_Europe/ISR_Israel/TA_Tel-Aviv/ISR_TA_Tel.Aviv-Ben.Gurion.Intl.AP.401800_TMYx.zip
https://climate.onebuilding.org/WMO_Region_6_Europe/ISR_Israel/JM_Yerushalayim/ISR_JM_Jerusalem.Center.401830_TMYx.2004-2018.zip
https://climate.onebuilding.org/WMO_Region_6_Europe/PSE_Palestine/PSE_WBK_Hebron.402400_TMYx.zip
https://climate.onebuilding.org/WMO_Region_6_Europe/PSE_Palestine/PSE_GZZ_Gaza.623380_TMYx.zip
https://climate.onebuilding.org/WMO_Region_6_Europe/PSE_Palestine/PSE_GZZ_Yasser.Arafat.Intl.AP-Gaza.Intl.AP.402300_TMYx.zip
https://climate.onebuilding.org/WMO_Region_6_Europe/ISR_Israel/D_HaDarom/ISR_D_Beer.Sheva-Teyman.AP.401910_TMYx.zip
https://climate.onebuilding.org/WMO_Region_6_Europe/ISR_Israel/D_HaDarom/ISR_D_Beer.Sheva.401900_TMYx.zip
https://climate.onebuilding.org/WMO_Region_6_Europe/ISR_Israel/D_HaDarom/ISR_D_Ovda.AP.401980_TMYx.zip
https://climate.onebuilding.org/WMO_Region_6_Europe/ISR_Israel/D_HaDarom/ISR_D_Eilat-Hozman.AP.401990_TMYx.zip""")
split = TextSplit(Text=epw_link_list_israel, Separators="/")
item = ListItem(List=reverse(split), Index=0, Wrap=True)
split_2 = TextSplit(Text=item, Separators="_")
item_2 = ListItem(List=split_2, Index=2, Wrap=True)  # -> flatten(Item)
dropdown_list = UiDropdownList(Values=item_2, Index=7)
get_values = UIValues(Element=dropdown_list)
item_3 = ListItem(List=epw_link_list_israel, Index=get_values, Wrap=True)

# ----
rh_sel_btn = UiRhinoSelectButton(Label="Location (Point)", Filter=1)
get_values_2 = UIValues(Element=rh_sel_btn)

# ---- group: North rotate
dom = ConstructDomain(DomainStart="0", DomainEnd="360")
slider = UISlider(Label="North", Value=Slider(0, range=0..360), Bounds=dom, Increment=Slider(1, range=0..1))
get_values_3 = UiValues(Element=slider)

# ----
# Title
panel = Panel("A wind rose is a graphical tool that displays how wind speed and direction are distributed at a specific location over a set period")
text_block = UITextBlock(Text=panel)

# ----
# Settings
list = ValueList({"Body": 0, "Bold": 1, "Title": 2, "Subtitle": 3, "Subtext": 4}, selected="Body")
label = UILabel(Label="Analysis period- Start to End", Style=list)

check_box = UiCheckBox(Label="Show Avarage", State=False)
get_values_4 = UiValues(Element=check_box)
panel_2 = Panel(get_values_4)

text_block_2 = UITextBlock(Text="Wind Rose")
units_check = GhPythonScript()
# ---------- units_check: Python ----------
import rhinoscriptsyntax as rs
import Rhino
import scriptcontext as sc
from System.Windows.Forms import MessageBox

# Get the active Rhino document
doc = Rhino.RhinoDoc.ActiveDoc

# Check if the document is not using meters as the unit
if doc.ModelUnitSystem != Rhino.UnitSystem.Meters:
    # Display a popup message with additional instructions
    MessageBox.Show(
        "Warning: Rhino document units are not set to meters.\n\n"
        "Please close Rhino completely, reopen it, change the units to Meters, "
        "and only then open the Grasshopper file.",
        "Units Check"
    )
# ---------- end units_check ----------
pt = Point(get_values_2)
panel_3 = Panel("""0
1
2""")
panel_4 = Panel("""0
0
0""")
panel_5 = Panel("""0
0
0""")
panel_6 = Panel("""0
1
2""")
panel_7 = Panel(item_3)
panel_8 = Panel("""0
0
0""")
panel_9 = Panel("""0
1
2""")
relay = Relay()

# ----
# Run
panel_10 = Panel("Run")
button = UiButton(Label=panel_10)
get_values_5 = UiValues(Element=button)

bool = Boolean(get_values_5)
reset_button = Python3Script(x=bool)  # -> out, a
# ---------- reset_button: Python ----------
import Grasshopper as gh

# Make 'previous' persist across script executions
global previous
try:
    previous
except NameError:
    previous = False

# Default output
pulse = False

# Detect a rising edge: (x == True) AND (previous == False)
if x and not previous:
    pulse = True
    # Schedule an immediate re-calculation to reset output
    doc = ghenv.Component.OnPingDocument()
    if doc:
        doc.ScheduleSolution(1, lambda d: ghenv.Component.ExpireSolution(False))

# Store the current state for next run
previous = x

# Output the one-shot pulse
a = pulse
# ---------- end reset_button ----------
font = UiSetFont(Element=[text_block_2, button], Family="Rajdhani", Size=20, Bold=True)

panel_11 = Panel(reset_button.a)

list_2 = ValueList({"Left": 0, "Center": 1, "Right": 2, "Stretch": 3}, selected="Stretch")
resize = UiResize(Element=[dropdown_list, button, rh_sel_btn], Alignment=list_2)

card = UiCardLayout(Elements=button, Title="Run")

# ---- group: Start Month
number_slider = Slider(1, range=0..10)
number_slider_2 = Slider(1, range=1..12)
toggle = BooleanToggle(True)
panel_12 = Panel("End Month (1-12)")
dom_2 = ConstructDomain(DomainStart="1", DomainEnd="12")

# ----
scroll_integer = UIScrollInteger(Integer=number_slider_2, Wrap=toggle, Increment=number_slider, Bounds=dom_2)

# ---- group: Start Month (continued)
get_values_6 = UiValues(Element=scroll_integer)
panel_13 = Panel(get_values_6)

# ---- group: Start Day
number_slider_3 = Slider(1, range=0..10)
number_slider_4 = Slider(1, range=0..23)
toggle_2 = BooleanToggle(True)
panel_14 = Panel("End Day (1-31)")
dom_3 = ConstructDomain(DomainStart="0", DomainEnd="31")

# ----
scroll_integer_2 = UIScrollInteger(Integer=number_slider_4, Wrap=toggle_2, Increment=number_slider_3, Bounds=dom_3)

# ---- group: Start Day (continued)
get_values_7 = UiValues(Element=scroll_integer_2)
panel_15 = Panel(get_values_7)

# ---- group: Start Month
number_slider_5 = Slider(1, range=0..10)
number_slider_6 = Slider(1, range=1..12)
toggle_3 = BooleanToggle(True)
panel_16 = Panel("Start Month (1-12)")
dom_4 = ConstructDomain(DomainStart="1", DomainEnd="12")

# ----
scroll_integer_3 = UIScrollInteger(Integer=number_slider_6, Wrap=toggle_3, Increment=number_slider_5, Bounds=dom_4)

# ---- group: Start Month (continued)
get_values_8 = UiValues(Element=scroll_integer_3)
panel_17 = Panel(get_values_8)

# ---- group: Start Hour Time
panel_18 = Panel("Start Hour(0-23)")
number_slider_7 = Slider(1, range=0..10)
number_slider_8 = Slider(8, range=0..23)
toggle_4 = BooleanToggle(True)
dom_5 = ConstructDomain(DomainStart="0", DomainEnd="23")

# ----
scroll_integer_4 = UIScrollInteger(Integer=number_slider_8, Wrap=toggle_4, Increment=number_slider_7, Bounds=dom_5)

# ---- group: Start Hour Time (continued)
get_values_9 = UiValues(Element=scroll_integer_4)
panel_19 = Panel(get_values_9)

# ---- group: Start Day
number_slider_9 = Slider(1, range=0..10)
number_slider_10 = Slider(8, range=0..23)
toggle_5 = BooleanToggle(True)
panel_20 = Panel("Start Day (1-31)")
dom_6 = ConstructDomain(DomainStart="0", DomainEnd="31")

# ----
scroll_integer_5 = UIScrollInteger(Integer=number_slider_10, Wrap=toggle_5, Increment=number_slider_9, Bounds=dom_6)

# ---- group: Start Day (continued)
get_values_10 = UiValues(Element=scroll_integer_5)
panel_21 = Panel(get_values_10)

# ----
merge = Merge(Data1=flatten(panel_18), Data2=flatten(panel_20), Data3=flatten(panel_16))

panel_22 = Panel(merge)
list_3 = ValueList({"Body": 0, "Bold": 1, "Title": 2, "Subtitle": 3, "Subtext": 4}, selected="Body")
label_2 = UILabel(Label=merge, Style=list_3)

merge_2 = Merge(Data1=flatten(scroll_integer_4), Data2=flatten(scroll_integer_5), Data3=flatten(scroll_integer_3))
grid = UiGridLayout(Elements=label_2, Columns=panel_6, Rows=panel_5)
grid_2 = UiGridLayout(Elements=merge_2, Columns=panel_6, Rows=panel_5)

# ---- group: End Hour Time
number_slider_11 = Slider(1, range=0..10)
number_slider_12 = Slider(8, range=0..23)
toggle_6 = BooleanToggle(True)
panel_23 = Panel("End Hour (0-23)")
dom_7 = ConstructDomain(DomainStart="0", DomainEnd="23")

# ----
scroll_integer_6 = UIScrollInteger(Integer=number_slider_12, Wrap=toggle_6, Increment=number_slider_11, Bounds=dom_7)

# ---- group: End Hour Time (continued)
get_values_11 = UiValues(Element=scroll_integer_6)
panel_24 = Panel(get_values_11)

# ----
merge_3 = Merge(Data1=flatten(panel_23), Data2=flatten(panel_14), Data3=flatten(panel_12))

panel_25 = Panel(merge_3)
list_4 = ValueList({"Body": 0, "Bold": 1, "Title": 2, "Subtitle": 3, "Subtext": 4}, selected="Body")
label_3 = UILabel(Label=merge_3, Style=list_4)

merge_4 = Merge(Data1=flatten(scroll_integer_6), Data2=flatten(scroll_integer_2), Data3=flatten(scroll_integer))
grid_3 = UiGridLayout(Elements=merge_4, Columns=panel_3, Rows=panel_4)
grid_4 = UiGridLayout(Elements=label_3, Columns=panel_9, Rows=panel_8)
merge_5 = Merge(
    Data1=flatten(dropdown_list),
    Data2=flatten(rh_sel_btn),
    Data3=flatten(slider),
    Data5=flatten(label),
    Data6=flatten(grid),
    Data7=flatten(grid_2),
    Data8=flatten(grid_4),
    Data9=flatten(grid_3),
    Data10=flatten(check_box))

card_2 = UiCardLayout(Elements=merge_5, Title="Analysis Settings")

spacer = UiSpacer(Width=10, Horizontal=False)
merge_6 = Merge(Data2=flatten(spacer), Data3=flatten(card_2), Data4=flatten(spacer), Data5=flatten(card))
panel_26 = Panel(merge_6)
lng = ListLength(List=merge_6)
merge_7 = Merge(Data1=flatten(merge_6))
dup = DuplicateData(Data="Analysis", Number=lng, Order=True)
tab = UiTabbedLayout(Elements=merge_7, Names=dup)

swatch = ColourSwatch(SwatchColor=RGB(237, 237, 237))
merge_8 = Merge(Data2=flatten(card), Data3=flatten(card_2))
swatch_2 = ColourSwatch(SwatchColor=RGB(237, 237, 237))
graphics = UiSetGraphics(
    Element=merge_8,
    PrimaryColor=ColourSwatch(SwatchColor=RGB(0, 0, 0)),
    AccentColor=ColourSwatch(SwatchColor=RGB(255, 255, 255)),
    StrokeColor=swatch_2,
    StrokeWeight=0)
graphics_2 = UiSetGraphics(
    Element=rh_sel_btn,
    PrimaryColor=ColourSwatch(SwatchColor=RGB(115, 115, 115)),
    AccentColor=swatch_2,
    StrokeColor=swatch_2,
    StrokeWeight=0)

analysisperiod = LBAnalysisPeriod(
    start_month=get_values_8,
    start_day=get_values_10,
    start_hour=get_values_9,
    end_month=get_values_6,
    end_day=get_values_7,
    end_hour=get_values_11)  # -> period, hoys, dates; plug-in component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

# ---- group: ad
dam = DataDam(DataScale_Sun=get_values_4, BufferDelay=10000000, BufferMode=0)
dam_2 = DataDam(DataGeoInputs=item_3, BufferDelay=10000000, BufferMode=0)
dam_3 = DataDam(DataNorth=get_values_3, BufferDelay=10000000, BufferMode=0)
dam_4 = DataDam(DataEPW=pt, BufferDelay=10000000, BufferMode=0)
dam_5 = DataDam(DataHoy=analysisperiod.period, BufferDelay=10000000, BufferMode=0)
objfromgroup = GetObjectsInGroup()

# ----
# 2 .EPW Link
downloadepw = LBDownloadWeather(weather_URL=dam_2)  # -> epw_file, stat_file, ddy_file; plug-in component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

lng_2 = ListLength(List=objfromgroup)
dup_2 = DuplicateData(Data=reset_button.a, Number=lng_2, Order=True)
setobj = SetObjectValue(ObjectToSet=objfromgroup, ValueToSet=dup_2)

# ----
# 3 .Analysis Settings
center_pt = Point(dam_4)

windrose = WindRose(epw_file=downloadepw.epw_file, north=dam_3, I=center_pt, show_avg=dam, period=dam_5)  # -> log, prevailing_2, angles, mesh, average_m_s, compass, orient_line, freq_line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
panel_27 = Panel(windrose.log)
panel_28 = Panel(windrose.prevailing)

# ----
# Data
frequency_per_direction_hours = Panel(windrose.L)
orientations_degrees = Panel(windrose.angles)
average_values_per_direction_m_s = Panel(windrose.average_m_s)
prevailing_direction = Panel(windrose.prevailing_2)

# ----
# VIZ
merge_9 = Merge(
    Data1=windrose.mesh,
    Data2=windrose.compass,
    Data3=windrose.orient_line,
    Data4=windrose.freq_line,
    Data5=windrose.legend,
    Data6=windrose.title)

merge_10 = Merge(Data1=flatten(text_block_2), Data2=flatten(text_block), Data3=flatten(tab))
font_2 = UiSetFont(Element=merge_10, Family="Rajdhani")

pt_2 = Point(Point(0, 0, 0))
pt_3 = ConstructPoint(XCoordinate=Slider(75, range=0..200), YCoordinate=Slider(51, range=0..500), ZCoordinate=0)
window = UIWindow(Elements=merge_10, Title="ArchiTool V3.0", Owner=2, Scroll=True, Launch=Toggle(True))
modify_win = UiModifyWindow(Window=window, Position=pt_3, HideControls=True, HideTitle=True)

# ==== cluster WindRose
epw_file = ClusterInput()
item = ListItem(List=epw_file, Index=0, Wrap=True)

authorization_v3_0_3_limit_vercel = Python3Script(toggle=item)  # -> out, a
# ---------- authorization_v3_0_3_limit_vercel: Python ----------
import clr 
import Rhino
import json

clr.AddReference("System")
from System.Net import WebClient, WebException, WebExceptionStatus, HttpWebResponse

# Node.js server URL
AUTH_URL = "https://architool-v3-server.vercel.app/authorize"

def check_authorization(serial_number):
    """
    Checks authorization by querying the Node.js server with the given serial number.
    
    Parameters:
        serial_number (str): The Rhino serial number.

    Returns:
        tuple: (authorized (bool), message (str), return_value (int))
               When authorized, return_value is the remaining daily uses.
               When an error occurs, return_value is an error code:
                   20 = Internet connection error
                   30 = Server connection error
                   40 = JSON parsing error
                   50 = Unexpected error
                   60 = Unauthorized access error
    """
    try:
        # Build the full URL with query parameter
        url = "{}?serialNumber={}".format(AUTH_URL, serial_number)
        wc = WebClient()
        response_data = wc.DownloadString(url)
        
        # Parse the JSON response
        data = json.loads(response_data)
        authorized = data.get('authorized', False)
        message = data.get('message', "No message").strip()
        remaining_uses = data.get('remainingUses', 0)
        
        return authorized, message, remaining_uses
    
    except WebException as web_ex:
        # If the exception has a response, we try to inspect it for status code details
        if web_ex.Response is not None:
            http_response = web_ex.Response
            # Ensure we have an HttpWebResponse to extract status code information
            if isinstance(http_response, HttpWebResponse):
                status_code = int(http_response.StatusCode)
                if status_code in (401, 403):
                    return False, "Error: Unauthorized access.", 60
        # Differentiate between internet connection issues and server issues
        if web_ex.Status in (WebExceptionStatus.ConnectFailure, 
                             WebExceptionStatus.NameResolutionFailure, 
                             WebExceptionStatus.ProxyNameResolutionFailure):
            return False, "Error: Internet connection problem. Please check your network connection.", 20
        else:
            return False, "Error: Problem connecting to the server.", 30

    except ValueError as json_err:
        return False, "Error: JSON parsing error: " + str(json_err), 40
    except Exception as e:
        return False, "Error: Unexpected error: " + str(e), 50

def process_authorization(toggle):
    """
    Processes the authorization check based on the toggle value.

    Parameters:
        toggle (bool): If True, perform the authorization check; if False, skip it.
    """
    if not toggle:
        print("Toggle is set to False. Skipping authorization check.")
        print("0")
        return

    # Get the Rhino serial number; check if valid
    serial_number = Rhino.RhinoApp.SerialNumber
    if not serial_number:
        print("Error: Could not retrieve the Rhino serial number. Please ensure Rhino is properly licensed.")
        print("10")
        return

    authorized, message, code = check_authorization(serial_number)

    # Handle the response based on the return code
    if authorized:
        print("Active Educational License")
        print("Remaining Daily Uses: {}".format(code))
        print("1")
    elif "daily usage limit reached" in message.lower():
        print("Error: Daily limit for your educational license has been reached.")
        print("Please contact support at info@01Architecture.com for assistance.")
        print("3")
    else:
        # For error cases, print the error message and its corresponding error code
        print(message)
        print(code)

if __name__ == "__main__":
    toggle = True  # Change this based on your Grasshopper input
    process_authorization(toggle)
    print("01A_ArchiTools V3.0.3")
# ---------- end authorization_v3_0_3_limit_vercel ----------
item_2 = ListItem(List=authorization_v3_0_3_limit_vercel.out, Index=0, Wrap=True)  # -> Item2, Item1, Item, Item1_2
panel = Panel(authorization_v3_0_3_limit_vercel.out)
autorized = Data(item_2.Item2)
equals = Equality(FirstNumber=autorized, SecondNumber=1)  # -> Equality, Inequality
filter = StreamFilter(Gate=equals.Equality, Stream0=item_2.Item2)
concat = Concatenate(FragmentA=item_2.Item, FragmentC=" ", FragmentB=filter)

panel_2 = Panel(item_2.Item1_2)
panel_3 = Panel(concat)
log = ClusterOutput([concat, item_2.Item1_2])
filter_2 = StreamFilter(Gate=autorized, Stream1=epw_file)
importepw = LBImportEPW(epw_file=filter_2)  # -> location, dry_bulb_temperature, dew_point_temperature, relative_humidity, wind_speed, wind_direction, direct_normal_rad, diffuse_horizontal_rad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; plug-in component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
panel_4 = Panel("0 <= a < 25 and 0 <= b < 25")  # disabled
I = ClusterInput()
pt = Point(Point(0, 0, 0))
null = NullItem(Item=I)  # -> NullFlags, InvalidFlags, Description
show_avg = ClusterInput()
filter_3 = StreamFilter(Gate=null.NullFlags, Stream0=I, Stream1=pt)
period = ClusterInput()
north = ClusterInput()
xdata = LBDeconstructData(data=importepw.wind_speed)  # -> header, values; disabled; plug-in component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
xdata_2 = LBDeconstructData(data=importepw.dry_bulb_temperature)  # -> header, values; disabled; plug-in component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
windrose = LBWindRose(
    north=north,
    data=[importepw.wind_speed, importepw.dry_bulb_temperature, importepw.relative_humidity],
    wind_direction=importepw.wind_direction,
    dir_count=Slider(16, range=0..100),
    center_pt=filter_3,
    show_avg=show_avg,
    statement=panel_4,
    period=period)  # -> report, mesh, compass, orient_line, freq_line, windrose_line, legend, title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; plug-in component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
panel_5 = Panel(xdata.values)
panel_6 = Panel(xdata.header)
data = Data(windrose.freq_line)
panel_7 = Panel(xdata_2.header)  # disabled
panel_8 = Panel(xdata_2.values)  # disabled
explode = Explode(Curve=data, Recursive=True)  # -> Segments, Vertices
data_2 = Data(windrose.windrose_line)  # disabled
panel_9 = Panel(windrose.angles)
midpt = CurveMiddle(Curve=explode.Segments)
area = Area(Geometry=data_2)  # -> Area, Centroid; disabled
compass = ClusterOutput(windrose.compass)
mesh = ClusterOutput(windrose.mesh)
orient_line = ClusterOutput(windrose.orient_line)
freq_line = ClusterOutput(windrose.freq_line)
legend = ClusterOutput(windrose.legend)
bang = ExplodeTree(Data=graft(windrose.histogram))  # -> _0000, _0001
title = ClusterOutput(windrose.title)
prevailing = ClusterOutput(windrose.prevailing)
data_3 = Data(windrose.orient_line)
end = EndPoints(Curve=data_3)  # -> Start, End
xmatrix = LBDeconstructMatrix(matrix=bang._0000)  # -> values; plug-in component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
xmatrix_2 = LBDeconstructMatrix(matrix=bang._0001)  # -> values; plug-in component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
Y = UnitY(Factor=1)
data_4 = Data(end.Start)
line = LineSDL(Start=data_4, Direction=Y, Length=1)
avr = Average(Input=xmatrix)  # -> flatten(ArithmeticMean)
lng = ListLength(List=xmatrix_2)  # -> flatten(Length)
L = ClusterOutput(lng)
angles = ClusterOutput(windrose.angles)
average_m_s = ClusterOutput(avr)
prevailing_2 = ClusterOutput(windrose.prevailing)
